# Grasshopper definition Atrois.gh (Grasshopper 0.9.52)

fios = String("A")
airport_extreme = String(fios)
macbook_pro = String(airport_extreme)
iphone_5 = String(airport_extreme)
ipad = String(airport_extreme)
remote_control_and_render_control = String([iphone_5, ipad, macbook_pro])
lightning_av_dlna = String(iphone_5)
node_sensors = String(iphone_5)
imac = String([airport_extreme, remote_control_and_render_control])
assambler = String([imac, macbook_pro])
thunderbolt_i_o = String([imac, macbook_pro])
nodebased = String(assambler)
era_jawbone = String([macbook_pro, imac, iphone_5])
magma_express_box = String(thunderbolt_i_o)
programming_language = String(nodebased)
ocz_revodrive_3 = String([thunderbolt_i_o, imac, macbook_pro])
leapmotion = String([imac, macbook_pro])
nvidia = String([magma_express_box, programming_language])
audi_r8 = String([remote_control_and_render_control, ipad, iphone_5, macbook_pro])
ia_core_rack_server = String([ocz_revodrive_3, nvidia, fios, remote_control_and_render_control])
voice_recognition = String(ia_core_rack_server)
graphics_core = String(ia_core_rack_server)
programming_interface = String([graphics_core, voice_recognition])
paragmatic = String(programming_interface)
semantic = String(programming_interface)
syntaxis = String(programming_interface)
slave_programming = String([programming_interface, iphone_5])
ia_core = String([semantic, syntaxis, paragmatic, ia_core_rack_server, node_sensors])
parallel_users = String(ia_core)
hud = String([parallel_users, leapmotion])
lg_smart_tv = String([macbook_pro, imac, hud, magma_express_box, lightning_av_dlna])
herman_miller_aeron = String(lg_smart_tv)
gunnar_sheadog = String(lg_smart_tv)
spyder4_elite = String(lg_smart_tv)
lumoback = String(herman_miller_aeron)
plc = String([iphone_5, imac, macbook_pro, remote_control_and_render_control, audi_r8, hud, node_sensors])
_3d_cube_cloud = String([hud, programming_interface])
analytics_core = String([hud, _3d_cube_cloud])
google_glasses = String([iphone_5, hud, plc])
occulus_rift = String([iphone_5, hud, plc])
robotics = String([leapmotion, plc, hud])
floatsphere = String(robotics)
octopus = String(robotics)
drone = String([robotics, occulus_rift])
robi = String([robotics, occulus_rift])
arms = String(robotics)
floating = String(analytics_core)
drawing = String(floating)
types = String(floating)
thunderbolt_i_o_2 = String([robi, arms, octopus, floatsphere, drone])
curves = String(types)
surface = String(types)
point = String(types)
plane = String(types)
solids = String(types)
mesh = String(types)
overlayered = String([hud, analytics_core])
writing = String(floating)
connect_to_ia_core = String(thunderbolt_i_o_2)  # disabled
particles = String(ia_core)
modeling_core = String(overlayered)
evolutive = String([ia_core, semantic, syntaxis, paragmatic, ocz_revodrive_3])
explode = String(drawing)
isolate = String(drawing)
isometrics = String(drawing)
anotate = String(drawing)
_3d_grid = String(drawing)
sheets = String(drawing)
tree_layered = String(modeling_core)
simulation = String(particles)
instancing = String(particles)
other_languages = String(programming_interface)
physics = String(particles)
automation = String([evolutive, ia_core, semantic, syntaxis, paragmatic])
weather = String(simulation)
wind = String(simulation)
earthquake = String(simulation)
cloth = String(simulation)
explosions = String(simulation)
liquids = String(physics)
solids_2 = String(physics)
tts = String([evolutive, automation, other_languages])
procedural = String(tree_layered)
generative = String(tree_layered)
parametric = String(tree_layered)
facade = String([explode, isolate, isometrics, anotate, sheets, _3d_grid])
exterior = String([explode, isolate, isometrics, anotate, sheets, _3d_grid])
structure = String([explode, isolate, isometrics, anotate, _3d_grid, sheets])
interior = String([explode, isolate, isometrics, anotate, sheets, _3d_grid])
speech_control = String(tts)
modificators = String(parametric)
constraints = String(parametric)
electronics = String(procedural)
mechanics = String(procedural)
hydraulic = String(procedural)
spatial_network = String(exterior)
space_syntax = String(exterior)
ifc_standard = String([structure, writing])
permeability = String(exterior)
conectivity = String(exterior)
behaviors = String(exterior)
paneling = String(facade)
thermal = String(facade)
wind_2 = String(facade)
weight = String([structure, writing])
strees = String([structure, writing])
forces = String([structure, writing])
otoy_js = String([graphics_core, other_languages])
scrollers = String(modificators)
graphers = String(modificators)
sliders = String(modificators)
temperature = String([thermal, writing])
sketch = String(constraints)
detailing = String(ifc_standard)
vectors = String([wind_2, writing])
kinematics_core = String([octopus, arms, audi_r8, floatsphere, robi])
connect_to_ia_core_2 = String(otoy_js)
speed = String([wind_2, writing])
count = String([paneling, writing])
type = String([paneling, writing])
conceptual = String(sketch)
assambly = String([mechanics, constraints])
precision = String(sketch)
landscape = String([generative, constraints])
mobiliary = String([generative, constraints])
structure_2 = String([generative, constraints])
windows = String([generative, constraints])
wires = String([electronics, constraints])
pipe = String([hydraulic, constraints])
_3d = String(sketch)
pcb = String([electronics, constraints])
color = String(sketch)
stairs = String([generative, constraints])
wall = String([generative, _3d_grid])
facade_2 = String([generative, constraints])
doors = String([generative, constraints])
welding_type = String([detailing, writing, paneling])
conection_type = String([writing, detailing, paneling])
web_explorer = String(connect_to_ia_core_2)
texture = String(color)
circuits = String(pcb)
uv_mapping = String(texture)
keyframing = String([kinematics_core, welding_type, conection_type, detailing])
ik = String([kinematics_core, detailing, conection_type, welding_type])
bones = String(kinematics_core)
