# Grasshopper definition Charts.gh (Grasshopper 0.9.56)

number_slider = Slider(7, range=5..100)

# ---- group: ILUMINACION
path = FilePath("D:\Atrois\Architecture\Workshop\Posgrados\Worksheet.xlsx")
xl_path = XLFilePath(Filepath=path, Activate=Toggle(True))  # -> out, A
# ---------- xl_path: VB ----------
    If _Activate = True Then
      Dim arrOut As New list(Of Object)

      Dim oldCI As System.Globalization.CultureInfo = system.Threading.Thread.CurrentThread.CurrentCulture
      System.Threading.Thread.CurrentThread.CurrentCulture = New System.Globalization.CultureInfo("en-US")

      'Access Active Session of Excel
      Dim objExcel As Object
      objExcel = System.Runtime.InteropServices.Marshal.GetActiveObject("Excel.Application")

      objExcel.screenUpdating = False

      'Access Workbook: If no workbook is specified, uses the active Workbook, if workbook is specified and exists uses existing workbook,
      'If workbook Is specified And does Not exist creates a New workbook And saves it To current grasshopper filepath location,
      'If grasshopper has Not been saved, saves to desktop
      Dim excelWorkbook As Object
      If Workbook <> Nothing Then

        Dim oWorkbook As Object
        Dim bookBool As Boolean
        Dim bookPath As String

        For Each oWorkbook In objExcel.workbooks

          If oWorkbook.Name = Workbook Then

            bookBool = True
            Exit For

          End If
        Next oWorkbook

        If bookBool = True Then
          excelWorkbook = objExcel.Workbooks(Workbook).Activate
        Else
          If FilePath <> Nothing Then
            bookPath = FilePath
          Else
            If Owner.OnPingDocument().FilePath = Nothing Then
              bookPath = "C:\My Documents\Desktop"
            Else
              bookPath = Path.GetDirectoryName(Owner.OnPingDocument().FilePath)
            End If
          End If

          If System.IO.File.Exists(CStr(bookPath & "/" & Workbook)) Then
            objExcel.Workbooks.open(CStr(bookPath & "/" & Workbook))
          Else
            objExcel.Workbooks.add
            objExcel.activeWorkbook.SaveAs(bookPath & "/" & Workbook)
          End If

        End If
      End If
      excelWorkbook = objExcel.activeWorkbook

      'Access Sheet: If no sheet is specified, uses active sheet, if sheet is specified and exists uses existing sheet,
      'If sheet Is specified And does Not exist creates a New sheet
      Dim excelSheet As Object
      If sheet = Nothing Then
        excelSheet = objExcel.ActiveSheet
      Else
        Dim oSheet As Object
        Dim shtBool As Boolean

        For Each oSheet In excelWorkbook.Sheets

          If oSheet.Name = Sheet Then

            shtBool = True
            Exit For

          End If

        Next oSheet

        If shtBool = False Then
          excelWorkbook.WorkSheets.add().name = Sheet
        End If
        excelSheet = objExcel.Sheets(Sheet)
      End If

      arrOut.add(objExcel)
      arrOut.add(excelWorkbook)
      arrOut.add(excelSheet)

      excelSheet.activate
      objExcel.screenUpdating = True
      A = arrOut
    End If
# ---------- end xl_path ----------
xl_data_in = XLDataIn(Path=xl_path.A, Origin="8,2", Bound="57,8", Stream=Toggle(True))  # -> out, Data; inputs Path: list
# ---------- xl_data_in: VB ----------
    If _Stream = True Then
      'If _LIVE = True Then owner.ExpireSolution(True)

      Dim objExcel, excelWorkbook, excelSheet As Object

      If Path.Count() > 1 Then
        objExcel = Path.item(0)
        excelWorkbook = Path.item(1)
        excelSheet = Path.item(2)
      Else
        Dim oldCI As System.Globalization.CultureInfo = system.Threading.Thread.CurrentThread.CurrentCulture
        System.Threading.Thread.CurrentThread.CurrentCulture = New System.Globalization.CultureInfo("en-US")

        'Access Active Session of Excel if no Path is specified

        objExcel = System.Runtime.InteropServices.Marshal.GetActiveObject("Excel.Application")
        excelWorkbook = objExcel.activeWorkbook
        excelSheet = objExcel.ActiveSheet
      End If

      objExcel.screenUpdating = False

      Dim arrStr As New datatree(Of Object)
      Dim i,j,k As Integer

      'specify a range in excel and stream data
      If Origin = Nothing Then
        Origin.T1 = excelSheet.usedrange.row
        Origin.T0 = excelSheet.usedrange.column
      End If
      If Bound = Nothing Then
        Bound.T0 = excelSheet.usedrange.rows(excelSheet.usedrange.rows.count).row
        Bound.T1 = excelSheet.usedrange.columns(excelSheet.usedrange.columns.count).column
      End If
      Dim rng As Object
      If ByColumn = True Then
        rng = excelSheet.Range(excelSheet.Cells(Origin.T1, Origin.T0), excelSheet.Cells(Bound.T0, Bound.T1)).value
        rng = objExcel.transpose(rng)
      Else
        rng = excelSheet.Range(excelSheet.Cells(Origin.T1, Origin.T0), excelSheet.Cells(Bound.T0, Bound.T1)).value
      End If
      k = 0
      For i = LBound(rng, 1) To UBound(rng, 1) Step 1
        Dim ghPath As New GH_Path(k)
        For j = LBound(rng, 2) To UBound(rng, 2) Step 1
          arrStr.add(rng(i, j), ghPath)
        Next
        k = k + 1
      Next

      excelSheet.activate
      objExcel.screenUpdating = True
      Data = arrStr

    End If
# ---------- end xl_data_in ----------
tstat = TreeStatistics(Tree=xl_data_in.Data)  # -> Paths, Length, Count
lng = ListLength(List=tstat.Length)
number_slider_2 = Slider(-80, range=-500..500)
series = Series(Start=0, Step=1, Count=lng)
item = TreeItem(Tree=xl_data_in.Data, Path=series, Index=1, Wrap=True)  # -> flatten(Element)
item_2 = TreeItem(Tree=xl_data_in.Data, Path=series, Index=5, Wrap=True)  # -> flatten(Element)
division = Division(A=item_2, B=10)  # -> flatten(Result)
lng_2 = ListLength(List=division)
series_2 = Series(Start=0, Step=number_slider, Count=lng_2)
X = UnitX(Factor=1)
pt = ConstructPoint(XCoordinate=number_slider_2, YCoordinate=series_2, ZCoordinate=0)
line = LineSDL(Start=pt, Direction=X, Length=division)
end = EndPoints(Curve=line)  # -> Start, End
loft = Loft(Curves=line, Options={Adjust=False, Closed=False, Rebuild=10, Refit=0.01, LoftType=0, LoftEnds=0, LoftSimp=0})
X_2 = UnitX(Factor=1)
item_3 = ListItem(List=pt, Index=0, Wrap=True)
item_4 = ListItem(List=end.Start, Index=Slider(55, range=0..100), Wrap=True)
amp = Amplitude(Vector=X_2, Amplitude=Slider(7, range=0..100))
crv = Curve(loft)
ln = Line(StartPoint=item_3, EndPoint=item_4)
move = Move(Geometry=end.End, Motion=amp)  # -> Geometry, Transform
explode = Explode(Curve=crv, Recursive=True)  # -> Segments, Vertices
item_5 = ListItem(List=explode.Segments, Index=2, Wrap=True)
offset = Offset(Curve=item_5, Distance=-1, Plane=PlaneXY(0, 0, 0), Corners=1)
edgesrf = EdgeSurface(CurveA=offset, CurveB=item_5)
tag = TextTag3D(Location=move.Geometry, Text=item, Size=2.5)

# ---- group: BOX
dom = ConstructDomain(DomainStart=0, DomainEnd=Slider(50, range=0..100))
dom_2 = ConstructDomain(DomainStart=0, DomainEnd=Slider(50, range=0..100))
rectangle = Rectangle(Plane=PlaneXY(0, 0, 0), XSize=dom, YSize=dom_2, Radius=0)  # -> Rectangle, Length
path_2 = FilePath("D:\Atrois\Architecture\Workshop\Posgrados\Worksheet.xlsx")
boxrec = BoxRectangle(Rectangle=rectangle.Rectangle, Height=Slider(250, range=0..1000))
xl_path_2 = XLFilePath(Filepath=path_2, Activate=Toggle(True))  # -> out, A; same code as xl_path
xl_data_in_2 = XLDataIn(Path=xl_path_2.A, Origin="6,2", Bound="57,6", Stream=Toggle(True))  # -> out, flatten(Data); inputs Path: list; same code as xl_data_in
lng_3 = ListLength(List=xl_data_in_2.Data)
sqrt = SquareRoot(Value=xl_data_in_2.Data)
popgeo = PopulateGeometry(Geometry=boxrec, Count=lng_3, Seed=Slider(16, range=0..100))
prox = Proximity3D(Points=popgeo, Group=5)  # -> Links, Topology
box = CenterBox(Base=popgeo, X=sqrt, Y=sqrt, Z=Slider(7, range=0..1000))
sdiff = SolidDifference(BrepsA=boxrec, BrepsB=box)

# ---- group: PERMANENCIA
path_3 = FilePath("D:\Atrois\Architecture\Workshop\Posgrados\Worksheet.xlsx")
xl_path_3 = XLFilePath(Filepath=path_3, Activate=Toggle(True))  # -> out, A; same code as xl_path
xl_data_in_3 = XLDataIn(Path=xl_path_3.A, Origin="11,2", Bound="57,11", Stream=Toggle(True))  # -> out, Data; inputs Path: list; same code as xl_data_in
tstat_2 = TreeStatistics(Tree=xl_data_in_3.Data)  # -> Paths, Length, Count
lng_4 = ListLength(List=tstat_2.Length)
series_3 = Series(Start=0, Step=1, Count=lng_4)
item_6 = TreeItem(Tree=xl_data_in_3.Data, Path=series_3, Index=1, Wrap=True)  # -> flatten(Element)
item_7 = TreeItem(Tree=xl_data_in_3.Data, Path=series_3, Index=5, Wrap=True)  # -> flatten(Element)
division_2 = Division(A=item_7, B=10)  # -> flatten(Result)
lng_5 = ListLength(List=division_2)
series_4 = Series(Start=0, Step=number_slider, Count=lng_5)
X_3 = UnitX(Factor=1)
pt_2 = ConstructPoint(XCoordinate=number_slider_2, YCoordinate=series_4, ZCoordinate=0)
line_2 = LineSDL(Start=pt_2, Direction=X_3, Length=division_2)
end_2 = EndPoints(Curve=line_2)  # -> Start, End
offset_2 = Offset(Curve=line_2, Distance=-2, Plane=PlaneXY(0, 0, 0), Corners=1)
loft_2 = Loft(Curves=line_2, Options={Adjust=False, Closed=False, Rebuild=10, Refit=0.01, LoftType=3, LoftEnds=0, LoftSimp=0})
X_4 = UnitX(Factor=1)
graft = GraftTree(Tree=offset_2, IncludeNullItems=True, IncludeEmptyLists=True)
graft_2 = GraftTree(Tree=line_2, IncludeNullItems=True, IncludeEmptyLists=True)
item_8 = ListItem(List=pt_2, Index=0, Wrap=True)
item_9 = ListItem(List=end_2.Start, Index=Slider(55, range=0..100), Wrap=True)
amp_2 = Amplitude(Vector=X_4, Amplitude=Slider(-10, range=-100..100))
crv_2 = Curve(loft_2)
edgesrf_2 = EdgeSurface(CurveA=graft, CurveB=graft_2)
ln_2 = Line(StartPoint=item_8, EndPoint=item_9)
move_2 = Move(Geometry=pt_2, Motion=amp_2)  # -> Geometry, Transform
tag_2 = TextTag3D(Location=move_2.Geometry, Text=item_6, Size=2.5)

# ---- group: SONIDO
path_4 = FilePath("D:\Atrois\Architecture\Workshop\Posgrados\Worksheet.xlsx")
xl_path_4 = XLFilePath(Filepath=path_4, Activate=Toggle(True))  # -> out, A; same code as xl_path
xl_data_in_4 = XLDataIn(Path=xl_path_4.A, Origin="10,2", Bound="57,10", Stream=Toggle(True))  # -> out, Data; inputs Path: list; same code as xl_data_in
tstat_3 = TreeStatistics(Tree=xl_data_in_4.Data)  # -> Paths, Length, Count
lng_6 = ListLength(List=tstat_3.Length)
series_5 = Series(Start=0, Step=1, Count=lng_6)
item_10 = TreeItem(Tree=xl_data_in_4.Data, Path=series_5, Index=1, Wrap=True)  # -> flatten(Element)
item_11 = TreeItem(Tree=xl_data_in_4.Data, Path=series_5, Index=5, Wrap=True)  # -> flatten(Element)
division_3 = Division(A=item_11, B=10)  # -> flatten(Result)
lng_7 = ListLength(List=division_3)
series_6 = Series(Start=0, Step=number_slider, Count=lng_7)
X_5 = UnitX(Factor=1)
pt_3 = ConstructPoint(XCoordinate=Slider(-120, range=-500..500), YCoordinate=series_6, ZCoordinate=0)
line_3 = LineSDL(Start=pt_3, Direction=X_5, Length=division_3)
offset_3 = Offset(Curve=line_3, Distance=-2, Plane=PlaneXY(0, 0, 0), Corners=1)
end_3 = EndPoints(Curve=line_3)  # -> Start, End
loft_3 = Loft(Curves=line_3, Options={Adjust=False, Closed=False, Rebuild=10, Refit=0.01, LoftType=3, LoftEnds=0, LoftSimp=0})
X_6 = UnitX(Factor=1)
item_12 = ListItem(List=pt_3, Index=0, Wrap=True)
item_13 = ListItem(List=end_3.Start, Index=Slider(55, range=0..100), Wrap=True)
amp_3 = Amplitude(Vector=X_6, Amplitude=Slider(3, range=0..100))
crv_3 = Curve(loft_3)
ln_3 = Line(StartPoint=item_12, EndPoint=item_13)
move_3 = Move(Geometry=end_3.End, Motion=amp_3)  # -> Geometry, Transform
graft_3 = GraftTree(Tree=offset_3, IncludeNullItems=True, IncludeEmptyLists=True)
graft_4 = GraftTree(Tree=line_3, IncludeNullItems=True, IncludeEmptyLists=True)
edgesrf_3 = EdgeSurface(CurveA=graft_3, CurveB=graft_4)
tag_3 = TextTag3D(Location=move_3.Geometry, Text=item_10, Size=2.5)

# ---- group: PRIVACIDAD
path_5 = FilePath("D:\Atrois\Architecture\Workshop\Posgrados\Worksheet.xlsx")
xl_path_5 = XLFilePath(Filepath=path_5, Activate=Toggle(True))  # -> out, A; same code as xl_path
xl_data_in_5 = XLDataIn(Path=xl_path_5.A, Origin="9,2", Bound="57,9", Stream=Toggle(True))  # -> out, Data; inputs Path: list; same code as xl_data_in
tstat_4 = TreeStatistics(Tree=xl_data_in_5.Data)  # -> Paths, Length, Count
lng_8 = ListLength(List=tstat_4.Length)
series_7 = Series(Start=0, Step=1, Count=lng_8)
item_14 = TreeItem(Tree=xl_data_in_5.Data, Path=series_7, Index=1, Wrap=True)  # -> flatten(Element)
item_15 = TreeItem(Tree=xl_data_in_5.Data, Path=series_7, Index=5, Wrap=True)  # -> flatten(Element)
division_4 = Division(A=item_15, B=10)  # -> flatten(Result)
lng_9 = ListLength(List=division_4)
series_8 = Series(Start=0, Step=number_slider, Count=lng_9)
X_7 = UnitX(Factor=1)
pt_4 = ConstructPoint(XCoordinate=Slider(-40, range=-500..500), YCoordinate=series_8, ZCoordinate=0)
line_4 = LineSDL(Start=pt_4, Direction=X_7, Length=division_4)
dash = DashPattern(Curve=line_4, Pattern=0.5)  # -> Dashes, Gaps
end_4 = EndPoints(Curve=line_4)  # -> Start, End
loft_4 = Loft(Curves=line_4, Options={Adjust=False, Closed=False, Rebuild=10, Refit=0.01, LoftType=0, LoftEnds=0, LoftSimp=0})
X_8 = UnitX(Factor=1)
item_16 = ListItem(List=pt_4, Index=0, Wrap=True)
item_17 = ListItem(List=end_4.Start, Index=Slider(55, range=0..100), Wrap=True)
cir = Circle(Plane=end_4.End, Radius=1)
amp_4 = Amplitude(Vector=X_8, Amplitude=Slider(3, range=0..100))
crv_4 = Curve(loft_4)
ln_4 = Line(StartPoint=item_16, EndPoint=item_17)
move_4 = Move(Geometry=end_4.End, Motion=amp_4)  # -> Geometry, Transform
offset_4 = Offset(Curve=cir, Distance=0.25, Plane=PlaneXY(0, 0, 0), Corners=1)
crv_5 = Curve([offset_4, cir])
tag_4 = TextTag3D(Location=move_4.Geometry, Text=item_14, Size=2.5)

# ---- group: DISTRIBUCION
number_slider_3 = Slider(9, range=0..10)
number_slider_4 = Slider(45, range=0..100)
number_slider_5 = Slider(7, range=0..10)
number_slider_6 = Slider(45, range=0..100)
multiplication = Multiplication(A=number_slider_4, B=number_slider_5)
multiplication_2 = Multiplication(A=number_slider_6, B=number_slider_3)
series_9 = Series(Start=0, Step=number_slider_4, Count=number_slider_5)
series_10 = Series(Start=0, Step=number_slider_6, Count=number_slider_3)
Y = UnitY(Factor=1)
pt_5 = ConstructPoint(XCoordinate=0, YCoordinate=series_9, ZCoordinate=0)
pt_6 = ConstructPoint(XCoordinate=series_10, YCoordinate=0, ZCoordinate=0)
X_9 = UnitX(Factor=1)
Y_2 = UnitY(Factor=1)
amp_5 = Amplitude(Vector=Y, Amplitude=multiplication)
line_5 = LineSDL(Start=pt_6, Direction=Y_2, Length=multiplication)
line_6 = LineSDL(Start=pt_5, Direction=X_9, Length=multiplication_2)
path_6 = FilePath("D:\Atrois\Architecture\Workshop\Posgrados\Worksheet.xlsx")
mcx = MultipleCurves(Curves=[line_5, line_6])  # -> Points, IndexA, IndexB, ParamA, ParamB
xl_path_6 = XLFilePath(Filepath=path_6, Activate=Toggle(True))  # -> out, A; same code as xl_path
xl_data_in_6 = XLDataIn(Path=xl_path_6.A, Origin="6,2", Bound="57,6", Stream=Toggle(True))  # -> out, Data; inputs Path: list; same code as xl_data_in
pt_7 = ConstructPoint(XCoordinate=Slider(100, range=-500..500), YCoordinate=Slider(50, range=-500..500), ZCoordinate=0)
Y_3 = UnitY(Factor=1)
graft_5 = GraftTree(Tree=mcx.Points, IncludeNullItems=True, IncludeEmptyLists=True)
sqrt_2 = SquareRoot(Value=xl_data_in_6.Data)
move_5 = Move(Geometry=graft_5, Motion=pt_7)  # -> Geometry, Transform
amp_6 = Amplitude(Vector=Y_3, Amplitude=Slider(1, range=0..1))
rectangle_2 = Rectangle(Plane=move_5.Geometry, XSize=sqrt_2, YSize=sqrt_2, Radius=0)  # -> Rectangle, Length
move_6 = Move(Geometry=move_5.Geometry, Motion=amp_6)  # -> Geometry, Transform
tag_5 = TextTag3D(Location=move_6.Geometry, Text=xl_data_in_6.Data, Size=1)

# ----
# Carga el Path de Excel
# Lee el archivo de Excel
# Origin (Primer punto de Lectura) funciona mediante matrices, asi que 1,1 = A1
# Bound (Ultimo punto de Lectura) tambien funciona como matriz.
toggle = BooleanToggle(True)
path_7 = FilePath("D:\Atrois\Architecture\Workshop\Posgrados\Worksheet.xlsx")
xl_path_7 = XLFilePath(Filepath=path_7, Activate=toggle)  # -> out, A; same code as xl_path
xl_data_in_7 = XLDataIn(Path=xl_path_7.A, Origin="1,2", Bound="57,6", Stream=Toggle(True))  # -> out, Data; inputs Path: list; same code as xl_data_in
tstat_5 = TreeStatistics(Tree=xl_data_in_7.Data)  # -> Paths, Length, Count
lng_10 = ListLength(List=tstat_5.Length)
series_11 = Series(Start=0, Step=1, Count=lng_10)
item_18 = TreeItem(Tree=xl_data_in_7.Data, Path=series_11, Index=1, Wrap=True)
item_19 = TreeItem(Tree=xl_data_in_7.Data, Path=series_11, Index=5, Wrap=True)  # -> flatten(Element)
panel = Panel(item_19)
panel_2 = Panel(item_18)
division_5 = Division(A=item_19, B=10)  # -> flatten(Result)
lng_11 = ListLength(List=division_5)
series_12 = Series(Start=0, Step=number_slider, Count=lng_11)
X_10 = UnitX(Factor=1)
pt_8 = ConstructPoint(XCoordinate=0, YCoordinate=series_12, ZCoordinate=0)
line_7 = LineSDL(Start=pt_8, Direction=X_10, Length=division_5)
end_5 = EndPoints(Curve=line_7)  # -> Start, End
loft_5 = Loft(Curves=line_7, Options={Adjust=False, Closed=False, Rebuild=10, Refit=0.01, LoftType=0, LoftEnds=0, LoftSimp=0})
X_11 = UnitX(Factor=1)
amp_7 = Amplitude(Vector=X_11, Amplitude=Slider(0, range=0..100))
crv_6 = Curve(loft_5)
move_7 = Move(Geometry=end_5.End, Motion=amp_7)  # -> Geometry, Transform
tag_6 = TextTag3D(Location=move_7.Geometry, Text=item_18, Size=2.5)

path_8 = FilePath("D:\Atrois\Architecture\Workshop\Posgrados\Worksheet.xlsx")

# ---- group: DENSIDAD
xl_path_8 = XLFilePath(Filepath=path_8, Activate=Toggle(True))  # -> out, A; same code as xl_path
xl_data_in_8 = XLDataIn(Path=xl_path_8.A, Origin="1,2", Bound="57,6", Stream=Toggle(True))  # -> out, Data; inputs Path: list; same code as xl_data_in
tstat_6 = TreeStatistics(Tree=xl_data_in_8.Data)  # -> Paths, Length, Count
lng_12 = ListLength(List=tstat_6.Length)
series_13 = Series(Start=0, Step=1, Count=lng_12)
item_20 = TreeItem(Tree=xl_data_in_8.Data, Path=series_13, Index=3, Wrap=True)  # -> flatten(Element)
lng_13 = ListLength(List=item_20)
series_14 = Series(Start=0, Step=number_slider, Count=lng_13)
X_12 = UnitX(Factor=1)
pt_9 = ConstructPoint(XCoordinate=0, YCoordinate=series_14, ZCoordinate=0)
line_8 = LineSDL(Start=pt_9, Direction=X_12, Length=item_20)
end_6 = EndPoints(Curve=line_8)  # -> Start, End
loft_6 = Loft(Curves=line_8, Options={Adjust=False, Closed=False, Rebuild=10, Refit=0.01, LoftType=0, LoftEnds=0, LoftSimp=0})
crv_7 = Curve(loft_6)

# ----
path_9 = FilePath("D:\Atrois\Architecture\Workshop\Posgrados\Worksheet.xlsx")
xl_path_9 = XLFilePath(Filepath=path_9, Activate=Toggle(True))  # -> out, A; same code as xl_path
xl_data_in_9 = XLDataIn(Path=xl_path_9.A, Origin="7,2", Bound="57,7", Stream=Toggle(True))  # -> out, flatten(Data); inputs Path: list; same code as xl_data_in
lng_14 = ListLength(List=xl_data_in_9.Data)
pt_10 = ConstructPoint(XCoordinate=Slider(-230, range=-500..500), YCoordinate=0, ZCoordinate=0)
rectangle_3 = Rectangle(Plane=pt_10, XSize=Domain(0, 70), YSize=Domain(0, 100), Radius=0)  # -> Rectangle, Length
rectangle_4 = Rectangle(Plane=pt_10, XSize=Domain(-10, 80), YSize=Domain(-10, 110), Radius=0)  # -> Rectangle, Length
pop2d = Populate2D(Region=rectangle_3.Rectangle, Count=lng_14, Seed=Slider(0, range=0..100))
cir_2 = Circle(Plane=pop2d, Radius=xl_data_in_9.Data)
fspin = SpinForce(Plane=cir_2, Strength=1, Radius=xl_data_in_9.Data, Decay=2)
mergef = MergeFields(Fields=fspin)
fdir = DirectionDisplay(Field=mergef, Section=rectangle_4.Rectangle, Samples=100)
ftensor = TensorDisplay(Field=mergef, Section=rectangle_4.Rectangle, Samples=1000)

pl_offset = PlaneOffset(BasePlane=cir_2, Offset=20)

tag_7 = TextTag3D(Location=pl_offset, Text=item_18, Size=1)

# ---- group: FORCE
path_10 = FilePath("D:\Atrois\Architecture\Workshop\Posgrados\Worksheet.xlsx")
xl_path_10 = XLFilePath(Filepath=path_10, Activate=Toggle(False))  # -> out, A; same code as xl_path
xl_data_in_10 = XLDataIn(Path=xl_path_10.A, Origin="7,2", Bound="57,7", Stream=Toggle(True))  # -> out, flatten(Data); inputs Path: list; same code as xl_data_in
lng_15 = ListLength(List=xl_data_in_10.Data)
pt_11 = ConstructPoint(XCoordinate=Slider(50, range=-500..500), YCoordinate=Slider(-190, range=-500..500), ZCoordinate=0)
cir_3 = Circle(Plane=pt_11, Radius=Slider(100, range=0..100))
divide = DivideCurve(Curve=cir_3, Count=lng_15, Kinks=False)  # -> Points, Tangents, Parameters
ln_5 = Line(StartPoint=cir_3, EndPoint=divide.Points)
end_7 = EndPoints(Curve=ln_5)  # -> Start, End
cir_4 = Circle(Plane=end_7.End, Radius=xl_data_in_10.Data)
crv_8 = Curve([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])

# ----
line_9 = LineSDL(Start=end_7.End, Direction=ln_5, Length=Slider(15, range=0..100))
pt_12 = Point(end_7.End)
end_8 = EndPoints(Curve=line_9)  # -> Start, End

# ---- group: FORCE (continued)
align = AlignPlane(Plane=end_8.End, Direction=ln_5)  # -> Plane, Angle
tag_8 = TextTag3D(Location=align.Plane, Text=item_18, Size=2.5)

# ----
path_11 = FilePath("D:\Atrois\Architecture\Workshop\Posgrados\Worksheet.xlsx")
xl_path_11 = XLFilePath(Filepath=path_11, Activate=Toggle(True))  # -> out, A; same code as xl_path
xl_data_in_11 = XLDataIn(Path=xl_path_11.A, Origin="3,2", Bound="57,3", Stream=Toggle(True))  # -> out, flatten(Data); inputs Path: list; same code as xl_data_in
X_13 = UnitX(Factor=1)

lng_16 = ListLength(List=xl_data_in_11.Data)

series_15 = Series(Start=0, Step=1, Count=lng_16)
series_16 = Series(Start=0, Step=number_slider, Count=lng_16)
pt_13 = ConstructPoint(XCoordinate=0, YCoordinate=series_16, ZCoordinate=0)
line_10 = LineSDL(Start=pt_13, Direction=X_13, Length=1)
end_9 = EndPoints(Curve=line_10)  # -> Start, End
loft_7 = Loft(Curves=line_10, Options={Adjust=False, Closed=False, Rebuild=10, Refit=0.01, LoftType=0, LoftEnds=0, LoftSimp=0})
crv_9 = Curve(loft_7)
