# Grasshopper definition Terrain CVS.gh (Grasshopper 0.9.12)

path = FilePath("D:\Tesla\Documentos 2\Nube Puntos Edit Zero.txt")
file = ReadFile(Path=path, Lines=True)
split = StringSplit(String=file, Separators=",")
panel = Panel(file)
simplify = SimplifyTree(Tree=split, Front=False)
item = ListItem(List=simplify, Index=1, Wrap=False)
item_2 = ListItem(List=simplify, Index=2, Wrap=False)
item_3 = ListItem(List=simplify, Index=0, Wrap=False)
panel_2 = Panel(simplify)
panel_3 = Panel(item_2)
join = StringJoin(Strings=[item_3, item, item_2], Join=",")
flatten = FlattenTree(Data=join, Path="{0}")
panel_4 = Panel(flatten)
split_2 = StringSplit(String=flatten, Separators=",")
simplify_2 = SimplifyTree(Tree=split_2, Front=False)
panel_5 = Panel(simplify_2)
pt2num = NumbersToPoints(Numbers=simplify_2, Mask=4)  # -> flatten(Points)
points = PointList(Points=pt2num, Tags=True, Lines=Toggle(True), Size=100)
del = DelaunayMesh(Points=pt2num, Plane=PlaneXY(0, 0, 0))
panel_6 = Panel(pt2num)
