# Grasshopper definition Terrain Curves.gh (Grasshopper 0.9.61)

crv = Curve(<curve referenced from the Rhino model>)
explode = Explode(Curve=crv, Recursive=True)  # -> Segments, Vertices
item = ListItem(List=explode.Segments, Index=1, Wrap=True)
item_2 = ListItem(List=explode.Segments, Index=0, Wrap=True)
number_slider = Slider(30, range=0..100)
len = Length(Curve=item_2)
perp_frames = PerpFrames(Curve=item_2, Count=number_slider, Align=True)  # -> Frames, Parameters
multiplication = Multiplication(A=number_slider, B=4)
multiplication_2 = Multiplication(A=len, B=-1)
divide = DivideCurve(Curve=item, Count=multiplication, Kinks=False)  # -> Points, Tangents, Parameters
yz = YZPlane(Origin=Point(0, 0, 0))
curve = Curve([<curve referenced from the Rhino model> x151])
graft_tree = GraftTree(Tree=perp_frames.Frames, IncludeEmptyLists=True, IncludeNullItems=True)
reb = RebuildCurve(Curve=curve, Degree=3, Count=10, Tangents=False)
line = LineSDL(Start=divide.Points, Direction=yz, Length=multiplication_2)
curve_plane = CurvePlane(Curve=reb, Plane=graft_tree)  # -> flatten(Points), ParamsC, ParamsP
item_3 = ListItem(List=line, Index=0, Wrap=True)
path_mapper = PathMapper(curve_plane.Points, source="{A;B;C;D}", target="{A;B;C}")
offset = Offset(Curve=item_3, Distance=1, Plane=PlaneXY(0, 0, 0), Corners=1)
deconstruct = Deconstruct(Point=path_mapper)  # -> XComponent, YComponent, ZComponent
sort_list = SortList(Keys=deconstruct.XComponent, ValuesValuesA=path_mapper)  # -> Keys, ValuesValuesA
polyline = PolyLine(Vertices=sort_list.ValuesValuesA, Closed=False)
flatten_tree = FlattenTree(Tree=polyline, Path="{0}")
loft = Loft(Curves=flatten_tree, Options={Adjust=False, Closed=False, LoftEnds=0, LoftSimp=1, LoftType=3, Rebuild=25, Refit=0.01})
