# Grasshopper definition Tour.gh (Grasshopper 0.8.52)

int = Integer()
crv = Curve(<curve referenced from the Rhino model>)
crv_2 = Curve(<curve referenced from the Rhino model>)
crv_3 = Curve(<curve referenced from the Rhino model>)
crvmid = Curve(<curve referenced from the Rhino model>)
int_2 = Integer(5)
crvtop = Curve(<curve referenced from the Rhino model>)
int_3 = Integer(5)
divide = DivideCurve(Curve=crv, Number=int_2, Kinks=False)  # -> Points, Tangents, Parameters
divide_2 = DivideCurve(Curve=crv_3, Number=int_2, Kinks=False)  # -> Points, Tangents, Parameters
divide_3 = DivideCurve(Curve=crv_2, Number=int_2, Kinks=False)  # -> Points, Tangents, Parameters
divide_4 = DivideCurve(Curve=crvmid, Number=int_3, Kinks=False)  # -> Points, Tangents, Parameters
divide_5 = DivideCurve(Curve=crvtop, Number=int_3, Kinks=False)  # -> Points, Tangents, Parameters
panel = Panel(divide.Points)
panel_2 = Panel(divide_2.Points)
panel_3 = Panel(divide_3.Points)
panel_4 = Panel(divide_5.Points)
slider = Slider(2, range=1..11)
panel_5 = Panel(divide_4.Points)
item = ListItem(List=panel_5, Index=3, Wrap=False)
item_2 = ListItem(List=panel_2, Index=2, Wrap=False)
item_3 = ListItem(List=panel_2, Index=1, Wrap=False)
item_4 = ListItem(List=panel_5, Index=4, Wrap=False)
item_5 = ListItem(List=panel_4, Index=4, Wrap=False)
item_6 = ListItem(List=panel_5, Index=2, Wrap=False)
item_7 = ListItem(List=panel_2, Index=3, Wrap=False)
item_8 = ListItem(List=panel_4, Index=0, Wrap=False)
item_9 = ListItem(List=panel_4, Index=3, Wrap=False)
item_10 = ListItem(List=panel, Index=4, Wrap=False)
item_11 = ListItem(List=panel, Index=0, Wrap=False)
item_12 = ListItem(List=panel_4, Index=0, Wrap=False)
item_13 = ListItem(List=panel_2, Index=4, Wrap=False)
item_14 = ListItem(List=panel_5, Index=0, Wrap=False)
item_15 = ListItem(List=panel_4, Index=1, Wrap=False)
item_16 = ListItem(List=panel_5, Index=1, Wrap=False)
item_17 = ListItem(List=panel_5, Index=4, Wrap=False)
item_18 = ListItem(List=panel_3, Index=1, Wrap=False)
item_19 = ListItem(List=panel_3, Index=4, Wrap=False)
item_20 = ListItem(List=panel_5, Index=2, Wrap=False)
item_21 = ListItem(List=panel_5, Index=0, Wrap=False)
item_22 = ListItem(List=panel_2, Index=0, Wrap=False)
item_23 = ListItem(List=panel_4, Index=2, Wrap=False)
item_24 = ListItem(List=panel_3, Index=0, Wrap=False)
item_25 = ListItem(List=panel_4, Index=1, Wrap=False)
item_26 = ListItem(List=panel_5, Index=0, Wrap=False)
item_27 = ListItem(List=panel_3, Index=3, Wrap=False)
item_28 = ListItem(List=panel_5, Index=3, Wrap=False)
item_29 = ListItem(List=panel_5, Index=1, Wrap=False)
item_30 = ListItem(List=panel_4, Index=2, Wrap=False)
item_31 = ListItem(List=panel, Index=3, Wrap=False)
item_32 = ListItem(List=panel_4, Index=4, Wrap=False)
item_33 = ListItem(List=panel_4, Index=3, Wrap=False)
item_34 = ListItem(List=panel_4, Index=1, Wrap=False)
item_35 = ListItem(List=panel_5, Index=4, Wrap=False)
item_36 = ListItem(List=panel_5, Index=1, Wrap=False)
item_37 = ListItem(List=panel_4, Index=2, Wrap=False)
item_38 = ListItem(List=panel_4, Index=0, Wrap=False)
item_39 = ListItem(List=panel_3, Index=2, Wrap=False)
item_40 = ListItem(List=panel, Index=2, Wrap=False)
item_41 = ListItem(List=panel_5, Index=3, Wrap=False)
item_42 = ListItem(List=panel_4, Index=4, Wrap=False)
item_43 = ListItem(List=panel, Index=1, Wrap=False)
item_44 = ListItem(List=panel_5, Index=2, Wrap=False)
item_45 = ListItem(List=panel_4, Index=3, Wrap=False)
crv_4 = Curve(Vertices=[item_11, item_16, item_23], Degree=slider, Periodic=False)  # -> Curve, Length, Domain
crv_5 = Curve(Vertices=[item_10, item_21, item_34], Degree=slider, Periodic=False)  # -> Curve, Length, Domain
crv_6 = Curve(Vertices=[item_31, item_35, item_38], Degree=slider, Periodic=False)  # -> Curve, Length, Domain
crv_7 = Curve(Vertices=[item_43, item_44, item_45], Degree=slider, Periodic=False)  # -> Curve, Length, Domain
crv_8 = Curve(Vertices=[item_40, item_41, item_42], Degree=slider, Periodic=False)  # -> Curve, Length, Domain
crv_9 = Curve(Vertices=[item_19, item_26, item_25], Degree=slider, Periodic=False)  # -> Curve, Length, Domain
crv_10 = Curve(Vertices=[item_24, item_36, item_37], Degree=slider, Periodic=False)  # -> Curve, Length, Domain
crv_11 = Curve(Vertices=[item_22, item_29, item_30], Degree=slider, Periodic=False)  # -> Curve, Length, Domain
crv_12 = Curve(Vertices=[item_13, item_14, item_15], Degree=slider, Periodic=False)  # -> Curve, Length, Domain
crv_13 = Curve(Vertices=[item_7, item_4, item_8], Degree=slider, Periodic=False)  # -> Curve, Length, Domain
crv_14 = Curve(Vertices=[item_2, item, item_5], Degree=slider, Periodic=False)  # -> Curve, Length, Domain
crv_15 = Curve(Vertices=[item_3, item_6, item_9], Degree=slider, Periodic=False)  # -> Curve, Length, Domain
crv_16 = Curve(Vertices=[item_18, item_20, item_33], Degree=slider, Periodic=False)  # -> Curve, Length, Domain
crv_17 = Curve(Vertices=[item_27, item_17, item_12], Degree=slider, Periodic=False)  # -> Curve, Length, Domain
crv_18 = Curve(Vertices=[item_39, item_28, item_32], Degree=slider, Periodic=False)  # -> Curve, Length, Domain
pipe = Pipe(
    Curve=[crv_4.Curve, crv_5.Curve, crv_6.Curve, crv_8.Curve, crv_7.Curve, crv_10.Curve, crv_9.Curve, crv_17.Curve, crv_18.Curve, crv_16.Curve, crv_11.Curve, crv_12.Curve, crv_13.Curve, crv_14.Curve, crv_15.Curve],
    Radius=0.5,
    Caps=0)
edgesrf = EdgeSurface(CurveA=crv_4.Curve, CurveB=crv_7.Curve)
edgesrf_2 = EdgeSurface(CurveA=crv_8.Curve, CurveB=[crv_7.Curve, crv_6.Curve])
edgesrf_3 = EdgeSurface(CurveA=[crv_4.Curve, crv_6.Curve], CurveB=crv_5.Curve)
edgesrf_4 = EdgeSurface(CurveA=crv_15.Curve, CurveB=[crv_14.Curve, crv_11.Curve])
edgesrf_5 = EdgeSurface(CurveA=crv_13.Curve, CurveB=[crv_14.Curve, crv_12.Curve])
edgesrf_6 = EdgeSurface(CurveA=crv_11.Curve, CurveB=crv_12.Curve)
edgesrf_7 = EdgeSurface(CurveA=crv_16.Curve, CurveB=[crv_18.Curve, crv_10.Curve])
edgesrf_8 = EdgeSurface(CurveA=crv_17.Curve, CurveB=crv_18.Curve)
edgesrf_9 = EdgeSurface(CurveA=[crv_10.Curve, crv_17.Curve], CurveB=crv_9.Curve)
divide_6 = DivideCurve(Curve=crv_8.Curve, Number=25, Kinks=False)  # -> Points, Tangents, Parameters
divide_7 = DivideCurve(Curve=crv_7.Curve, Number=25, Kinks=False)  # -> Points, Tangents, Parameters
divide_8 = DivideCurve(Curve=crv_5.Curve, Number=25, Kinks=False)  # -> Points, Tangents, Parameters
divide_9 = DivideCurve(Curve=crv_6.Curve, Number=25, Kinks=False)  # -> Points, Tangents, Parameters
divide_10 = DivideCurve(Curve=crv_4.Curve, Number=25, Kinks=False)  # -> Points, Tangents, Parameters
divide_11 = DivideCurve(Curve=crv_8.Curve, Number=25, Kinks=False)  # -> Points, Tangents, Parameters
divide_12 = DivideCurve(Curve=crv_7.Curve, Number=25, Kinks=False)  # -> Points, Tangents, Parameters
divide_13 = DivideCurve(Curve=crv_5.Curve, Number=25, Kinks=False)  # -> Points, Tangents, Parameters
divide_14 = DivideCurve(Curve=crv_6.Curve, Number=25, Kinks=False)  # -> Points, Tangents, Parameters
divide_15 = DivideCurve(Curve=crv_4.Curve, Number=25, Kinks=False)  # -> Points, Tangents, Parameters
divide_16 = DivideCurve(Curve=[crv_10.Curve, crv_9.Curve, crv_17.Curve, crv_18.Curve, crv_16.Curve], Number=25, Kinks=False)  # -> Points, Tangents, Parameters
divide_17 = DivideCurve(Curve=[crv_11.Curve, crv_12.Curve, crv_13.Curve, crv_14.Curve, crv_15.Curve], Number=25, Kinks=False)  # -> Points, Tangents, Parameters
panel_6 = Panel(divide_16.Points)
panel_7 = Panel(divide_17.Points)
panel_8 = Panel(divide_13.Points)
panel_9 = Panel(divide_14.Points)
panel_10 = Panel(divide_12.Points)
panel_11 = Panel(divide_11.Points)
panel_12 = Panel(divide_15.Points)
int_4 = Integer(1)
item_46 = ListItem(List=panel_12, Index=int_4, Wrap=False)
item_47 = ListItem(List=panel_9, Index=int_4, Wrap=False)
item_48 = ListItem(List=panel_8, Index=int_4, Wrap=False)
item_49 = ListItem(List=panel_11, Index=int_4, Wrap=False)
item_50 = ListItem(List=panel_10, Index=int_4, Wrap=False)
item_51 = ListItem(List=panel_12, Index=int_4, Wrap=False)
crv_19 = Curve(Vertices=[item_46, item_48, item_47, item_49, item_50, item_51], Degree=1, Periodic=False)  # -> Curve, Length, Domain
pipe_2 = Pipe(Curve=crv_19.Curve, Radius=0.3, Caps=0)
