# Grasshopper definition Volume.gh (Grasshopper 0.9.56)
# plug-ins: G E N E R A T I O N, LocalCode, LunchBox

path = FilePath("D:\Atrois\Architecture\Workshop\Posgrados\Worksheet 2.xlsx")
toggle = BooleanToggle(True)

xl_path = XLFilePath(Filepath=path, Activate=toggle)  # -> out, A
# ---------- xl_path: VB ----------
    If _Activate = True Then
      Dim arrOut As New list(Of Object)

      Dim oldCI As System.Globalization.CultureInfo = system.Threading.Thread.CurrentThread.CurrentCulture
      System.Threading.Thread.CurrentThread.CurrentCulture = New System.Globalization.CultureInfo("en-US")

      'Access Active Session of Excel
      Dim objExcel As Object
      objExcel = System.Runtime.InteropServices.Marshal.GetActiveObject("Excel.Application")

      objExcel.screenUpdating = False

      'Access Workbook: If no workbook is specified, uses the active Workbook, if workbook is specified and exists uses existing workbook,
      'If workbook Is specified And does Not exist creates a New workbook And saves it To current grasshopper filepath location,
      'If grasshopper has Not been saved, saves to desktop
      Dim excelWorkbook As Object
      If Workbook <> Nothing Then

        Dim oWorkbook As Object
        Dim bookBool As Boolean
        Dim bookPath As String

        For Each oWorkbook In objExcel.workbooks

          If oWorkbook.Name = Workbook Then

            bookBool = True
            Exit For

          End If
        Next oWorkbook

        If bookBool = True Then
          excelWorkbook = objExcel.Workbooks(Workbook).Activate
        Else
          If FilePath <> Nothing Then
            bookPath = FilePath
          Else
            If Owner.OnPingDocument().FilePath = Nothing Then
              bookPath = "C:\My Documents\Desktop"
            Else
              bookPath = Path.GetDirectoryName(Owner.OnPingDocument().FilePath)
            End If
          End If

          If System.IO.File.Exists(CStr(bookPath & "/" & Workbook)) Then
            objExcel.Workbooks.open(CStr(bookPath & "/" & Workbook))
          Else
            objExcel.Workbooks.add
            objExcel.activeWorkbook.SaveAs(bookPath & "/" & Workbook)
          End If

        End If
      End If
      excelWorkbook = objExcel.activeWorkbook

      'Access Sheet: If no sheet is specified, uses active sheet, if sheet is specified and exists uses existing sheet,
      'If sheet Is specified And does Not exist creates a New sheet
      Dim excelSheet As Object
      If sheet = Nothing Then
        excelSheet = objExcel.ActiveSheet
      Else
        Dim oSheet As Object
        Dim shtBool As Boolean

        For Each oSheet In excelWorkbook.Sheets

          If oSheet.Name = Sheet Then

            shtBool = True
            Exit For

          End If

        Next oSheet

        If shtBool = False Then
          excelWorkbook.WorkSheets.add().name = Sheet
        End If
        excelSheet = objExcel.Sheets(Sheet)
      End If

      arrOut.add(objExcel)
      arrOut.add(excelWorkbook)
      arrOut.add(excelSheet)

      excelSheet.activate
      objExcel.screenUpdating = True
      A = arrOut
    End If
# ---------- end xl_path ----------
xl_path_2 = XLFilePath(Filepath=path, Activate=toggle)  # -> out, A; same code as xl_path
xl_path_3 = XLFilePath(Filepath=path, Activate=toggle)  # -> out, A; same code as xl_path
xl_path_4 = XLFilePath(Filepath=path, Activate=toggle)  # -> out, A; same code as xl_path
xl_path_5 = XLFilePath(Filepath=path, Activate=toggle)  # -> out, A; same code as xl_path
xl_path_6 = XLFilePath(Filepath=path, Activate=toggle)  # -> out, A; same code as xl_path
xl_path_7 = XLFilePath(Filepath=path, Activate=toggle)  # -> out, A; same code as xl_path
xl_path_8 = XLFilePath(Filepath=path, Activate=toggle)  # -> out, A; same code as xl_path
xl_path_9 = XLFilePath(Filepath=path, Activate=toggle)  # -> out, A; same code as xl_path
xl_path_10 = XLFilePath(Filepath=path, Activate=toggle)  # -> out, A; same code as xl_path
xl_path_11 = XLFilePath(Filepath=path, Activate=toggle)  # -> out, A; same code as xl_path
xl_path_12 = XLFilePath(Filepath=path, Activate=toggle)  # -> out, A; same code as xl_path
xl_path_13 = XLFilePath(Filepath=path, Activate=toggle)  # -> out, A; same code as xl_path
xl_path_14 = XLFilePath(Filepath=path, Activate=toggle)  # -> out, A; same code as xl_path
xl_data_in = XLDataIn(Path=xl_path.A, Origin="6,36", Bound="39,6", Stream=Toggle(True))  # -> out, flatten(Data); inputs Path: list
# ---------- xl_data_in: VB ----------
    If _Stream = True Then
      'If _LIVE = True Then owner.ExpireSolution(True)

      Dim objExcel, excelWorkbook, excelSheet As Object

      If Path.Count() > 1 Then
        objExcel = Path.item(0)
        excelWorkbook = Path.item(1)
        excelSheet = Path.item(2)
      Else
        Dim oldCI As System.Globalization.CultureInfo = system.Threading.Thread.CurrentThread.CurrentCulture
        System.Threading.Thread.CurrentThread.CurrentCulture = New System.Globalization.CultureInfo("en-US")

        'Access Active Session of Excel if no Path is specified

        objExcel = System.Runtime.InteropServices.Marshal.GetActiveObject("Excel.Application")
        excelWorkbook = objExcel.activeWorkbook
        excelSheet = objExcel.ActiveSheet
      End If

      objExcel.screenUpdating = False

      Dim arrStr As New datatree(Of Object)
      Dim i,j,k As Integer

      'specify a range in excel and stream data
      If Origin = Nothing Then
        Origin.T1 = excelSheet.usedrange.row
        Origin.T0 = excelSheet.usedrange.column
      End If
      If Bound = Nothing Then
        Bound.T0 = excelSheet.usedrange.rows(excelSheet.usedrange.rows.count).row
        Bound.T1 = excelSheet.usedrange.columns(excelSheet.usedrange.columns.count).column
      End If
      Dim rng As Object
      If ByColumn = True Then
        rng = excelSheet.Range(excelSheet.Cells(Origin.T1, Origin.T0), excelSheet.Cells(Bound.T0, Bound.T1)).value
        rng = objExcel.transpose(rng)
      Else
        rng = excelSheet.Range(excelSheet.Cells(Origin.T1, Origin.T0), excelSheet.Cells(Bound.T0, Bound.T1)).value
      End If
      k = 0
      For i = LBound(rng, 1) To UBound(rng, 1) Step 1
        Dim ghPath As New GH_Path(k)
        For j = LBound(rng, 2) To UBound(rng, 2) Step 1
          arrStr.add(rng(i, j), ghPath)
        Next
        k = k + 1
      Next

      excelSheet.activate
      objExcel.screenUpdating = True
      Data = arrStr

    End If
# ---------- end xl_data_in ----------
xl_data_in_2 = XLDataIn(Path=xl_path_2.A, Origin="2,36", Bound="39,2", Stream=Toggle(True))  # -> out, flatten(Data); inputs Path: list; same code as xl_data_in
xl_data_in_3 = XLDataIn(Path=xl_path_3.A, Origin="6,24", Bound="33,6", Stream=Toggle(True))  # -> out, flatten(Data); inputs Path: list; same code as xl_data_in
xl_data_in_4 = XLDataIn(Path=xl_path_4.A, Origin="2,24", Bound="33,2", Stream=Toggle(True))  # -> out, flatten(Data); inputs Path: list; same code as xl_data_in
xl_data_in_5 = XLDataIn(Path=xl_path_5.A, Origin="6,12", Bound="21,6", Stream=Toggle(True))  # -> out, flatten(Data); inputs Path: list; same code as xl_data_in
xl_data_in_6 = XLDataIn(Path=xl_path_6.A, Origin="2,12", Bound="21,2", Stream=Toggle(True))  # -> out, flatten(Data); inputs Path: list; same code as xl_data_in
xl_data_in_7 = XLDataIn(Path=xl_path_7.A, Origin="2,68", Bound="71,2", Stream=Toggle(True))  # -> out, flatten(Data); inputs Path: list; same code as xl_data_in
xl_data_in_8 = XLDataIn(Path=xl_path_8.A, Origin="6,68", Bound="71,6", Stream=Toggle(True))  # -> out, flatten(Data); inputs Path: list; same code as xl_data_in
xl_data_in_9 = XLDataIn(Path=xl_path_9.A, Origin="6,4", Bound="9,6", Stream=Toggle(True))  # -> out, flatten(Data); inputs Path: list; same code as xl_data_in
xl_data_in_10 = XLDataIn(Path=xl_path_10.A, Origin="2,4", Bound="9,2", Stream=Toggle(True))  # -> out, flatten(Data); inputs Path: list; same code as xl_data_in
xl_data_in_11 = XLDataIn(Path=xl_path_11.A, Origin="6,42", Bound="51,6", Stream=Toggle(True))  # -> out, flatten(Data); inputs Path: list; same code as xl_data_in
xl_data_in_12 = XLDataIn(Path=xl_path_12.A, Origin="2,42", Bound="51,2", Stream=Toggle(True))  # -> out, flatten(Data); inputs Path: list; same code as xl_data_in
xl_data_in_13 = XLDataIn(Path=xl_path_13.A, Origin="6,54", Bound="65,6", Stream=Toggle(True))  # -> out, flatten(Data); inputs Path: list; same code as xl_data_in
xl_data_in_14 = XLDataIn(Path=xl_path_14.A, Origin="2,54", Bound="65,2", Stream=Toggle(True))  # -> out, flatten(Data); inputs Path: list; same code as xl_data_in
panel = Panel(xl_data_in_4.Data)
panel_2 = Panel(xl_data_in_6.Data)
panel_3 = Panel(xl_data_in_2.Data)
panel_4 = Panel(xl_data_in_7.Data)
panel_5 = Panel(xl_data_in_10.Data)
panel_6 = Panel(xl_data_in_12.Data)
panel_7 = Panel(xl_data_in_14.Data)

timer = Timer(TimerInterval=1000, Target=stopcount)
number_slider = Slider(9, range=0..10)
number_slider_2 = Slider(100, range=0..100)
multiplication = Multiplication(A=number_slider_2, B=number_slider)
series = Series(Start=0, Step=number_slider_2, Count=number_slider)
pt = ConstructPoint(XCoordinate=series, YCoordinate=0, ZCoordinate=0)
pt_2 = ConstructPoint(XCoordinate=0, YCoordinate=series, ZCoordinate=0)
Y = UnitY(Factor=1)
X = UnitX(Factor=1)
line = LineSDL(Start=pt, Direction=Y, Length=multiplication)
line_2 = LineSDL(Start=pt_2, Direction=X, Length=multiplication)
timer_2 = Timer(TimerInterval=1000, Target=stopcount_2)  # disabled
toggle_2 = BooleanToggle(False)
stopcount = StopCounter(Start=0, Step=1, Stop=100, Pause=toggle_2, Reset=False)
addition = Addition(A=stopcount, B=3)
addition_2 = Addition(A=stopcount, B=4)
addition_3 = Addition(A=stopcount, B=6)
addition_4 = Addition(A=stopcount, B=5)
addition_5 = Addition(A=stopcount, B=2)
addition_6 = Addition(A=stopcount, B=1)

# ---- group: AGRUPADA
ma = MassAddition(Input=xl_data_in_3.Data)  # -> Result, PartialResults
ma_2 = MassAddition(Input=xl_data_in_5.Data)  # -> Result, PartialResults
ma_3 = MassAddition(Input=xl_data_in_8.Data)  # -> Result, PartialResults
ma_4 = MassAddition(Input=xl_data_in_9.Data)  # -> Result, PartialResults
ma_5 = MassAddition(Input=xl_data_in.Data)  # -> Result, PartialResults
lng = ListLength(List=xl_data_in_3.Data)
sqrt = SquareRoot(Value=xl_data_in_3.Data)
sqrt_2 = SquareRoot(Value=ma.Result)
ma_6 = MassAddition(Input=xl_data_in_11.Data)  # -> Result, PartialResults
lng_2 = ListLength(List=xl_data_in_5.Data)
sqrt_3 = SquareRoot(Value=xl_data_in_5.Data)
sqrt_4 = SquareRoot(Value=ma_2.Result)
ma_7 = MassAddition(Input=xl_data_in_13.Data)  # -> Result, PartialResults
lng_3 = ListLength(List=xl_data_in_8.Data)
sqrt_5 = SquareRoot(Value=xl_data_in_8.Data)
sqrt_6 = SquareRoot(Value=ma_3.Result)
lng_4 = ListLength(List=xl_data_in_9.Data)
sqrt_7 = SquareRoot(Value=xl_data_in_9.Data)
sqrt_8 = SquareRoot(Value=ma_4.Result)
rectangle = Rectangle(Plane=PlaneXY(0, 0, 0), XSize=sqrt_2, YSize=sqrt_2, Radius=0)  # -> Rectangle, Length
lng_5 = ListLength(List=xl_data_in.Data)
sqrt_9 = SquareRoot(Value=xl_data_in.Data)
sqrt_10 = SquareRoot(Value=ma_5.Result)
lng_6 = ListLength(List=xl_data_in_11.Data)
rectangle_2 = Rectangle(Plane=PlaneXY(0, 0, 0), XSize=sqrt_4, YSize=sqrt_4, Radius=0)  # -> Rectangle, Length
sqrt_11 = SquareRoot(Value=xl_data_in_11.Data)
sqrt_12 = SquareRoot(Value=ma_6.Result)
rectangle_3 = Rectangle(Plane=PlaneXY(0, 0, 0), XSize=sqrt_6, YSize=sqrt_6, Radius=0)  # -> Rectangle, Length
lng_7 = ListLength(List=xl_data_in_13.Data)
sqrt_13 = SquareRoot(Value=xl_data_in_13.Data)
sqrt_14 = SquareRoot(Value=ma_7.Result)
rectangle_4 = Rectangle(Plane=PlaneXY(0, 0, 0), XSize=sqrt_8, YSize=sqrt_8, Radius=0)  # -> Rectangle, Length
rectangle_5 = Rectangle(Plane=PlaneXY(0, 0, 0), XSize=sqrt_10, YSize=sqrt_10, Radius=0)  # -> Rectangle, Length
rectangle_6 = Rectangle(Plane=PlaneXY(0, 0, 0), XSize=sqrt_12, YSize=sqrt_12, Radius=0)  # -> Rectangle, Length
pop2d = Populate2D(Region=rectangle.Rectangle, Count=lng, Seed=addition)
rectangle_7 = Rectangle(Plane=PlaneXY(0, 0, 0), XSize=sqrt_14, YSize=sqrt_14, Radius=0)  # -> Rectangle, Length
pop2d_2 = Populate2D(Region=rectangle_2.Rectangle, Count=lng_2, Seed=addition_2)
pop2d_3 = Populate2D(Region=rectangle_3.Rectangle, Count=lng_3, Seed=addition_3)
rectangle_8 = Rectangle(Plane=pop2d, XSize=sqrt, YSize=sqrt, Radius=0)  # -> Rectangle, Length
pop2d_4 = Populate2D(Region=rectangle_4.Rectangle, Count=lng_4, Seed=addition_4)
pop2d_5 = Populate2D(Region=rectangle_5.Rectangle, Count=lng_5, Seed=addition_5)
rectangle_9 = Rectangle(Plane=pop2d_2, XSize=sqrt_3, YSize=sqrt_3, Radius=0)  # -> Rectangle, Length
pop2d_6 = Populate2D(Region=rectangle_6.Rectangle, Count=lng_6, Seed=stopcount)
pop2d_7 = Populate2D(Region=rectangle_7.Rectangle, Count=lng_7, Seed=addition_6)
rectangle_10 = Rectangle(Plane=pop2d_3, XSize=sqrt_5, YSize=sqrt_5, Radius=0)  # -> Rectangle, Length
rectangle_11 = Rectangle(Plane=pop2d_4, XSize=sqrt_7, YSize=sqrt_7, Radius=0)  # -> Rectangle, Length
rectangle_12 = Rectangle(Plane=pop2d_5, XSize=sqrt_9, YSize=sqrt_9, Radius=0)  # -> Rectangle, Length
boundary = BoundarySurfaces(Edges=rectangle_8.Rectangle)
rectangle_13 = Rectangle(Plane=pop2d_6, XSize=sqrt_11, YSize=sqrt_11, Radius=0)  # -> Rectangle, Length
rectangle_14 = Rectangle(Plane=pop2d_7, XSize=sqrt_13, YSize=sqrt_13, Radius=0)  # -> Rectangle, Length
boundary_2 = BoundarySurfaces(Edges=rectangle_10.Rectangle)
boundary_3 = BoundarySurfaces(Edges=rectangle_9.Rectangle)
boundary_4 = BoundarySurfaces(Edges=rectangle_11.Rectangle)
boundary_5 = BoundarySurfaces(Edges=rectangle_12.Rectangle)
lng_8 = ListLength(List=boundary)
boundary_6 = BoundarySurfaces(Edges=rectangle_13.Rectangle)
boundary_7 = BoundarySurfaces(Edges=rectangle_14.Rectangle)
lng_9 = ListLength(List=boundary_3)
lng_10 = ListLength(List=boundary_2)
Z = UnitZ(Factor=1)
random = Random(Range=Domain(-4, 12), Number=lng_8, Seed=2)
lng_11 = ListLength(List=boundary_4)
lng_12 = ListLength(List=boundary_5)
Z_2 = UnitZ(Factor=1)
Z_3 = UnitZ(Factor=1)
lng_13 = ListLength(List=boundary_6)
random_2 = Random(Range=Domain(-12, 4), Number=lng_9, Seed=2)
random_3 = Random(Range=Domain(-4, 0), Number=lng_10, Seed=2)
Z_4 = UnitZ(Factor=1)
lng_14 = ListLength(List=boundary_7)
Z_5 = UnitZ(Factor=1)
amp = Amplitude(Vector=Z, Amplitude=random)
random_4 = Random(Range=Domain(0, 8), Number=lng_11, Seed=2)
random_5 = Random(Range=Domain(0, 8), Number=lng_12, Seed=2)
Z_6 = UnitZ(Factor=1)
Z_7 = UnitZ(Factor=1)
random_6 = Random(Range=Domain(-4, 8), Number=lng_13, Seed=2)
amp_2 = Amplitude(Vector=Z_2, Amplitude=random_2)
amp_3 = Amplitude(Vector=Z_3, Amplitude=random_3)
random_7 = Random(Range=Domain(-4, 0), Number=lng_14, Seed=2)
amp_4 = Amplitude(Vector=Z_4, Amplitude=random_4)
amp_5 = Amplitude(Vector=Z_5, Amplitude=random_5)
extr = Extrude(Base=boundary, Direction=amp)  # -> flatten(Extrusion)
amp_6 = Amplitude(Vector=Z_6, Amplitude=random_6)
amp_7 = Amplitude(Vector=Z_7, Amplitude=random_7)
extr_2 = Extrude(Base=boundary_3, Direction=amp_2)  # -> flatten(Extrusion)
extr_3 = Extrude(Base=boundary_2, Direction=amp_3)  # -> flatten(Extrusion)
rgb = ColourRGB(Alpha=255, Red=125, Green=0, Blue=125)
extr_4 = Extrude(Base=boundary_4, Direction=amp_4)  # -> flatten(Extrusion)
rgb_2 = ColourRGB(Alpha=255, Red=0, Green=0, Blue=255)
extr_5 = Extrude(Base=boundary_5, Direction=amp_5)  # -> flatten(Extrusion)
colour = ColourPicker(PickedColour=RGB(178, 178, 178))
rgb_3 = ColourRGB(Alpha=255, Red=0, Green=255, Blue=0)
rgb_4 = ColourRGB(Alpha=255, Red=255, Green=125, Blue=0)
rgb_5 = ColourRGB(Alpha=255, Red=255, Green=0, Blue=0)
extr_6 = Extrude(Base=boundary_6, Direction=amp_6)  # -> flatten(Extrusion)
cmyk = ColourCMYK(Cyan=0, Magenta=0, Yellow=1, Key=0)
extr_7 = Extrude(Base=boundary_7, Direction=amp_7)  # -> flatten(Extrusion)
volume = Volume(Geometry=extr_5)  # -> Volume, Centroid
volume_2 = Volume(Geometry=extr_4)  # -> Volume, Centroid
volume_3 = Volume(Geometry=extr)  # -> Volume, Centroid
volume_4 = Volume(Geometry=extr_2)  # -> Volume, Centroid
volume_5 = Volume(Geometry=extr_6)  # -> Volume, Centroid
volume_6 = Volume(Geometry=extr_3)  # -> Volume, Centroid
volume_7 = Volume(Geometry=extr_7)  # -> Volume, Centroid
pl_offset = PlaneOffset(BasePlane=volume_2.Centroid, Offset=20)
pl_offset_2 = PlaneOffset(BasePlane=volume_3.Centroid, Offset=20)
pl_offset_3 = PlaneOffset(BasePlane=volume_4.Centroid, Offset=20)
pl_offset_4 = PlaneOffset(BasePlane=volume_5.Centroid, Offset=20)
pl_offset_5 = PlaneOffset(BasePlane=volume_6.Centroid, Offset=20)
pl_offset_6 = PlaneOffset(BasePlane=volume.Centroid, Offset=20)
pl_offset_7 = PlaneOffset(BasePlane=volume_7.Centroid, Offset=20)
number_slider_3 = Slider(0.5, range=0..10)
preview = CustomPreview(Geometry=extr_6, Shader=cmyk)
preview_2 = CustomPreview(Geometry=extr_7, Shader=colour)
preview_3 = CustomPreview(Geometry=extr_2, Shader=rgb_3)
preview_4 = CustomPreview(Geometry=extr_5, Shader=rgb_5)
preview_5 = CustomPreview(Geometry=extr_4, Shader=rgb_2)
preview_6 = CustomPreview(Geometry=extr, Shader=rgb_4)
preview_7 = CustomPreview(Geometry=extr_3, Shader=rgb)
tag = TextTag3D(Location=pl_offset_5, Text=panel_4, Size=number_slider_3)
tag_2 = TextTag3D(Location=pl_offset, Text=panel_5, Size=number_slider_3)
tag_3 = TextTag3D(Location=pl_offset_3, Text=panel_2, Size=number_slider_3)
tag_4 = TextTag3D(Location=pl_offset_2, Text=panel, Size=number_slider_3)
tag_5 = TextTag3D(Location=pl_offset_6, Text=panel_3, Size=number_slider_3)
tag_6 = TextTag3D(Location=pl_offset_7, Text=panel_7, Size=number_slider_3)
tag_7 = TextTag3D(Location=pl_offset_4, Text=panel_6, Size=number_slider_3)

# ----
path_mapper = PathMapper(extr_2, source="{path_count}", target="{path_count+2}")
path_mapper_2 = PathMapper(extr_5, source="{path_count}", target="{path_count+4}")
path_mapper_3 = PathMapper(extr_7, source="{path_count}", target="{path_count+5}")
path_mapper_4 = PathMapper(extr_6, source="{path_count}", target="{path_count+6}")
path_mapper_5 = PathMapper(extr, source="{path_count}", target="{path_count+3}")
path_mapper_6 = PathMapper(extr_4, source="{path_count}", target="{path_count+1}")
path_mapper_7 = PathMapper(extr_3, source="{path_count}", target="{path_count}")
mcx = MultipleCurves(Curves=[line, line_2])  # -> Points, IndexA, IndexB, ParamA, ParamB
lng_15 = ListLength(List=mcx.Points)
stopcount_2 = StopCounter(Start=0, Step=1, Stop=lng_15, Pause=toggle_2, Reset=toggle_2)  # disabled
not = GateNot(A=toggle_2)
doclyrs = RhinoLayers()  # -> Layers, LayerColours
item = ListItem(List=mcx.Points, Index=stopcount_2, Wrap=True)
panel_8 = Panel(doclyrs.Layers)
brep = Brep([path_mapper_4, path_mapper_7, path_mapper_5, path_mapper_2, path_mapper_6, path_mapper_3, path_mapper])
move = Move(Geometry=brep, Motion=item)  # -> Geometry, Transform
bake = ObjectBake(
    BakeToggle=not,
    GeometryObjects=move.Geometry,
    Layer=doclyrs.Layers,
    ObjectName=doclyrs.Layers,
    ObjectColor=doclyrs.LayerColours,
    LayerColor=doclyrs.LayerColours)  # disabled

crv = Curve(flatten([rectangle_3.Rectangle, rectangle_4.Rectangle, rectangle_2.Rectangle, rectangle.Rectangle, rectangle_5.Rectangle, rectangle_7.Rectangle, rectangle_6.Rectangle]))
timer_3 = Timer(TimerInterval=1000, Target=vb)
vb = VBScript(minimum=Slider(0, range=0..1), maximum=Slider(100, range=0..100))  # -> out, A
# ---------- vb: VB ----------
    Dim r As New Random
    A = ((maximum - minimum) * r.NextDouble)+minimum
# ---------- end vb ----------
number_slider_4 = Slider(7, range=0..10)
random_8 = Random(Range=Domain(0, 7), Number=7, Seed=vb.A)
item_2 = ListItem(List=crv, Index=random_8, Wrap=True)  # -> flatten(Item)
series_2 = Series(Start=0, Step=number_slider_4, Count=6)
timer_4 = Timer(TimerInterval=1000, Target=vb_2)
pt_3 = ConstructPoint(XCoordinate=0, YCoordinate=0, ZCoordinate=series_2)  # -> flatten(Point)
vb_2 = VBScript(minimum=Slider(0, range=0..100), maximum=Slider(100, range=0..100))  # -> out, A; same code as vb
random_9 = Random(Range=Domain(0, 7), Number=number_slider_4, Seed=vb_2.A)  # -> flatten(Random)
item_3 = ListItem(List=pt_3, Index=random_9, Wrap=True)  # -> flatten(Item)
timer_5 = Timer(TimerInterval=1000, Target=[vb_9, vb_8, vb_4, vb_5, vb_6, vb_7, vb_10, vb_3])
move_2 = Move(Geometry=item_2, Motion=item_3)  # -> Geometry, Transform
boundary_8 = BoundarySurfaces(Edges=move_2.Geometry)
colour_2 = ColourPicker(PickedColour=RGB(178, 178, 178))
sort = SortList(Keys=boundary_8, ValuesA=boundary_8)  # -> Keys, ValuesA
rev = ReverseList(List=sort.ValuesA)
sqrt_15 = SquareRoot(Value="75")
lng_16 = ListLength(List="75")
rectangle_15 = Rectangle(Plane=PlaneXY(0, 0, 0), XSize=Domain(-10, 50), YSize=Domain(-10, 50), Radius=0)  # -> Rectangle, Length
vb_3 = VBScript(minimum=Slider(0, range=0..100), maximum=Slider(100, range=0..100))  # -> out, A; same code as vb
random_10 = Random(Range=Domain(0, 100), Number=1, Seed=vb_3.A)  # -> flatten(Random)
pop2d_8 = Populate2D(Region=rectangle_15.Rectangle, Count=lng_16, Seed=random_10)
vb_4 = VBScript(minimum=Slider(0, range=0..100), maximum=Slider(100, range=0..100))  # -> out, A; same code as vb
vb_5 = VBScript(minimum=Slider(0, range=0..100), maximum=Slider(100, range=0..100))  # -> out, A; same code as vb
vb_6 = VBScript(minimum=Slider(0, range=0..100), maximum=Slider(100, range=0..100))  # -> out, A; same code as vb
vb_7 = VBScript(minimum=Slider(0, range=0..100), maximum=Slider(100, range=0..100))  # -> out, A; same code as vb
vb_8 = VBScript(minimum=Slider(0, range=0..100), maximum=Slider(100, range=0..100))  # -> out, A; same code as vb
vb_9 = VBScript(minimum=Slider(0, range=0..100), maximum=Slider(100, range=0..100))  # -> out, A; same code as vb
rectangle_16 = Rectangle(Plane=pop2d_8, XSize=sqrt_15, YSize=sqrt_15, Radius=0)  # -> Rectangle, Length
vb_10 = VBScript(minimum=Slider(0, range=0..100), maximum=Slider(100, range=0..100))  # -> out, A; same code as vb
boundary_9 = BoundarySurfaces(Edges=rectangle_16.Rectangle)
area = Area(Geometry=rectangle_16.Rectangle)  # -> Area, Centroid
random_11 = Random(Range=Domain(4, 8), Number=1, Seed=vb_4.A)  # -> flatten(Random)
random_12 = Random(Range=Domain(4, 8), Number=1, Seed=vb_5.A)  # -> flatten(Random)
random_13 = Random(Range=Domain(4, 8), Number=1, Seed=vb_6.A)  # -> flatten(Random)
random_14 = Random(Range=Domain(4, 8), Number=1, Seed=vb_7.A)  # -> flatten(Random)
random_15 = Random(Range=Domain(4, 8), Number=1, Seed=vb_8.A)  # -> flatten(Random)
random_16 = Random(Range=Domain(4, 8), Number=1, Seed=vb_9.A)  # -> flatten(Random)
series_3 = Series(Start=0, Step=7, Count=6)
random_17 = Random(Range=Domain(4, 8), Number=1, Seed=vb_10.A)  # -> flatten(Random)
lng_17 = ListLength(List=boundary_9)
pt_4 = ConstructPoint(XCoordinate=0, YCoordinate=0, ZCoordinate=series_3)
item_4 = ListItem(List=rev, Index=0, Wrap=True)
item_5 = ListItem(List=rev, Index=1, Wrap=True)
item_6 = ListItem(List=rev, Index=2, Wrap=True)
item_7 = ListItem(List=rev, Index=3, Wrap=True)
item_8 = ListItem(List=rev, Index=4, Wrap=True)
item_9 = ListItem(List=rev, Index=5, Wrap=True)
item_10 = ListItem(List=rev, Index=6, Wrap=True)
Z_8 = UnitZ(Factor=1)
Z_9 = UnitZ(Factor=1)
Z_10 = UnitZ(Factor=1)
Z_11 = UnitZ(Factor=1)
Z_12 = UnitZ(Factor=1)
Z_13 = UnitZ(Factor=1)
Z_14 = UnitZ(Factor=1)
Z_15 = UnitZ(Factor=1)
random_18 = Random(Range=Domain(0, 55), Number=lng_17, Seed=2)
pl_offset_8 = PlaneOffset(BasePlane=area.Centroid, Offset=pt_4)
amp_8 = Amplitude(Vector=Z_12, Amplitude=random_15)
amp_9 = Amplitude(Vector=Z_13, Amplitude=random_16)
amp_10 = Amplitude(Vector=Z_8, Amplitude=random_11)
amp_11 = Amplitude(Vector=Z_9, Amplitude=random_12)
amp_12 = Amplitude(Vector=Z_10, Amplitude=random_13)
amp_13 = Amplitude(Vector=Z_11, Amplitude=random_14)
amp_14 = Amplitude(Vector=Z_15, Amplitude=random_17)
colour_3 = ColourPicker(PickedColour=RGB(178, 178, 178))
amp_15 = Amplitude(Vector=Z_14, Amplitude=random_18)
number_slider_5 = Slider(9, range=0..10)
number_slider_6 = Slider(100, range=0..100)
extr_8 = Extrude(Base=item_6, Direction=amp_10)
extr_9 = Extrude(Base=item_7, Direction=amp_11)
extr_10 = Extrude(Base=item_8, Direction=amp_12)
extr_11 = Extrude(Base=item_9, Direction=amp_13)
extr_12 = Extrude(Base=item_5, Direction=amp_9)
rgb_6 = ColourRGB(Alpha=255, Red=125, Green=0, Blue=125)
rgb_7 = ColourRGB(Alpha=255, Red=255, Green=125, Blue=0)
extr_13 = Extrude(Base=item_4, Direction=amp_8)
rgb_8 = ColourRGB(Alpha=255, Red=0, Green=255, Blue=0)
rgb_9 = ColourRGB(Alpha=255, Red=255, Green=0, Blue=0)
rgb_10 = ColourRGB(Alpha=255, Red=0, Green=0, Blue=255)
extr_14 = Extrude(Base=boundary_9, Direction=amp_15)
cmyk_2 = ColourCMYK(Cyan=0, Magenta=0, Yellow=1, Key=0)
extr_15 = Extrude(Base=item_10, Direction=amp_14)
doclyrs_2 = RhinoLayers()  # -> Layers, LayerColours
multiplication_2 = Multiplication(A=number_slider_6, B=number_slider_5)
panel_9 = Panel(doclyrs_2.Layers)
brep_2 = Brep([extr_15, extr_13, extr_9, extr_10, extr_12, extr_11, extr_8, extr_14])
series_4 = Series(Start=0, Step=number_slider_6, Count=number_slider_5)
pt_5 = ConstructPoint(XCoordinate=series_4, YCoordinate=0, ZCoordinate=0)
pt_6 = ConstructPoint(XCoordinate=0, YCoordinate=series_4, ZCoordinate=0)
Y_2 = UnitY(Factor=1)
X_2 = UnitX(Factor=1)
line_3 = LineSDL(Start=pt_5, Direction=Y_2, Length=multiplication_2)
line_4 = LineSDL(Start=pt_6, Direction=X_2, Length=multiplication_2)
mcx_2 = MultipleCurves(Curves=[line_3, line_4])  # -> Points, IndexA, IndexB, ParamA, ParamB
toggle_3 = BooleanToggle(False)
timer_6 = Timer(TimerInterval=1000, Target=stopcount_3)  # disabled
lng_18 = ListLength(List=mcx_2.Points)
stopcount_3 = StopCounter(Start=0, Step=1, Stop=lng_18, Pause=toggle_3, Reset=toggle_3)  # disabled
not_2 = GateNot(A=toggle_3)
item_11 = ListItem(List=mcx_2.Points, Index=stopcount_3, Wrap=True)
preview_8 = CustomPreview(Geometry=extr_13, Shader=rgb_6)
preview_9 = CustomPreview(Geometry=extr_12, Shader=rgb_10)
preview_10 = CustomPreview(Geometry=extr_8, Shader=rgb_8)
preview_11 = CustomPreview(Geometry=extr_9, Shader=rgb_7)
preview_12 = CustomPreview(Geometry=extr_10, Shader=rgb_9)
preview_13 = CustomPreview(Geometry=extr_11, Shader=colour_2)
preview_14 = CustomPreview(Geometry=extr_15, Shader=cmyk_2)
preview_15 = CustomPreview(Geometry=extr_14, Shader=colour_3)
move_3 = Move(Geometry=brep_2, Motion=item_11)  # -> Geometry, Transform
bake_2 = ObjectBake(
    BakeToggle=not_2,
    GeometryObjects=move_3.Geometry,
    Layer=doclyrs_2.Layers,
    ObjectName=doclyrs_2.Layers,
    ObjectColor=doclyrs_2.LayerColours,
    LayerColor=doclyrs_2.LayerColours)  # disabled

# ---- group: AGRUPADA ALTURA
data = Data([ma_4.Result, ma.Result, ma_5.Result, ma_6.Result, ma_2.Result, ma_7.Result, ma_3.Result])
sqrt_16 = SquareRoot(Value=data)
lng_19 = ListLength(List=data)
sort_2 = SortList(Keys=sqrt_16)  # -> Keys, ValuesA
rev_2 = ReverseList(List=sort_2.Keys)
series_5 = Series(Start=0, Step=Slider(7, range=0..10), Count=lng_19)
pt_7 = ConstructPoint(XCoordinate=0, YCoordinate=0, ZCoordinate=series_5)
txt = Text(["PARQUEADERO", "SALONES", "AUDITORIOS", "BIBLIOTECA", "ESPACIOS COMPLEMENTARIOS", "SERVICIOS", "ADMINISTRACION"])
rectangle_17 = Rectangle(Plane=pt_7, XSize=rev_2, YSize=rev_2, Radius=0)  # -> Rectangle, Length
loft = Loft(
    Curves=rectangle_17.Rectangle,
    Options={Adjust=False, Closed=False, Rebuild=10, Refit=0.01, LoftType=0, LoftEnds=0, LoftSimp=0})
tag_8 = TextTag(Location=pt_7, Text=txt)
scale = Scale(Geometry=loft, Center=Point(0, 0, 0), Factor=1.1)  # -> Geometry, Transform
item_12 = ListItem(List=pt_7, Index=1, Wrap=True)
item_13 = ListItem(List=pt_7, Index=0, Wrap=True)
item_14 = ListItem(List=pt_7, Index=3, Wrap=True)
item_15 = ListItem(List=pt_7, Index=4, Wrap=True)
item_16 = ListItem(List=pt_7, Index=2, Wrap=True)
item_17 = ListItem(List=pt_7, Index=5, Wrap=True)
item_18 = ListItem(List=pt_7, Index=6, Wrap=True)
move_4 = Move(Geometry=rectangle_10.Rectangle, Motion=item_13)  # -> Geometry, Transform
move_5 = Move(Geometry=rectangle_11.Rectangle, Motion=item_12)  # -> Geometry, Transform
move_6 = Move(Geometry=rectangle_9.Rectangle, Motion=item_16)  # -> Geometry, Transform
move_7 = Move(Geometry=rectangle_8.Rectangle, Motion=item_14)  # -> Geometry, Transform
move_8 = Move(Geometry=rectangle_12.Rectangle, Motion=item_15)  # -> Geometry, Transform
move_9 = Move(Geometry=rectangle_14.Rectangle, Motion=item_17)  # -> Geometry, Transform
move_10 = Move(Geometry=rectangle_13.Rectangle, Motion=item_18)  # -> Geometry, Transform
boundary_10 = BoundarySurfaces(Edges=move_7.Geometry)
boundary_11 = BoundarySurfaces(Edges=move_6.Geometry)
boundary_12 = BoundarySurfaces(Edges=move_4.Geometry)
boundary_13 = BoundarySurfaces(Edges=move_5.Geometry)
boundary_14 = BoundarySurfaces(Edges=move_8.Geometry)
lng_20 = ListLength(List=boundary_10)
boundary_15 = BoundarySurfaces(Edges=move_10.Geometry)
boundary_16 = BoundarySurfaces(Edges=move_9.Geometry)
lng_21 = ListLength(List=boundary_11)
lng_22 = ListLength(List=boundary_12)
Z_16 = UnitZ(Factor=1)
random_19 = Random(Range=Domain(7, 14), Number=lng_20, Seed=2)
lng_23 = ListLength(List=boundary_13)
lng_24 = ListLength(List=boundary_14)
Z_17 = UnitZ(Factor=1)
Z_18 = UnitZ(Factor=1)
lng_25 = ListLength(List=boundary_15)
random_20 = Random(Range=Domain(7, 14), Number=lng_21, Seed=2)
random_21 = Random(Range=Domain(7, 7), Number=lng_22, Seed=2)
lng_26 = ListLength(List=boundary_16)
Z_19 = UnitZ(Factor=1)
amp_16 = Amplitude(Vector=Z_16, Amplitude=random_19)
random_22 = Random(Range=Domain(7, 7), Number=lng_23, Seed=2)
Z_20 = UnitZ(Factor=1)
random_23 = Random(Range=Domain(7, 7), Number=lng_24, Seed=2)
Z_21 = UnitZ(Factor=1)
Z_22 = UnitZ(Factor=1)
random_24 = Random(Range=Domain(7, 14), Number=lng_25, Seed=2)
amp_17 = Amplitude(Vector=Z_17, Amplitude=random_20)
amp_18 = Amplitude(Vector=Z_18, Amplitude=random_21)
random_25 = Random(Range=Domain(7, 7), Number=lng_26, Seed=2)
amp_19 = Amplitude(Vector=Z_20, Amplitude=random_22)
amp_20 = Amplitude(Vector=Z_19, Amplitude=random_23)
amp_21 = Amplitude(Vector=Z_21, Amplitude=random_24)
amp_22 = Amplitude(Vector=Z_22, Amplitude=random_25)
rgb_11 = ColourRGB(Alpha=255, Red=125, Green=0, Blue=125)
rgb_12 = ColourRGB(Alpha=255, Red=0, Green=0, Blue=255)
colour_4 = ColourPicker(PickedColour=RGB(178, 178, 178))
rgb_13 = ColourRGB(Alpha=255, Red=0, Green=255, Blue=0)
rgb_14 = ColourRGB(Alpha=255, Red=255, Green=125, Blue=0)
rgb_15 = ColourRGB(Alpha=255, Red=255, Green=0, Blue=0)
number_slider_7 = Slider(0.689, range=0..10)
cmyk_3 = ColourCMYK(Cyan=0, Magenta=0, Yellow=1, Key=0)
item_19 = ListItem(List=rectangle_17.Rectangle, Index=0, Wrap=True)
item_20 = ListItem(List=rectangle_17.Rectangle, Index=1, Wrap=True)
item_21 = ListItem(List=rectangle_17.Rectangle, Index=2, Wrap=True)
item_22 = ListItem(List=rectangle_17.Rectangle, Index=3, Wrap=True)
item_23 = ListItem(List=rectangle_17.Rectangle, Index=4, Wrap=True)
item_24 = ListItem(List=rectangle_17.Rectangle, Index=5, Wrap=True)
item_25 = ListItem(List=rectangle_17.Rectangle, Index=6, Wrap=True)
extr_16 = Extrude(Base=boundary_16, Direction=amp_22)
volume_8 = Volume(Geometry=extr_16)  # -> Volume, Centroid
pl_offset_9 = PlaneOffset(BasePlane=volume_8.Centroid, Offset=20)
preview_16 = CustomPreview(Geometry=extr_16, Shader=colour_4)
extr_17 = Extrude(Base=boundary_14, Direction=amp_20)
volume_9 = Volume(Geometry=extr_17)  # -> Volume, Centroid
pl_offset_10 = PlaneOffset(BasePlane=volume_9.Centroid, Offset=20)
preview_17 = CustomPreview(Geometry=extr_17, Shader=rgb_15)
extr_18 = Extrude(Base=boundary_10, Direction=amp_16)
volume_10 = Volume(Geometry=extr_18)  # -> Volume, Centroid
pl_offset_11 = PlaneOffset(BasePlane=volume_10.Centroid, Offset=20)
preview_18 = CustomPreview(Geometry=extr_18, Shader=rgb_14)
extr_19 = Extrude(Base=boundary_15, Direction=amp_21)
volume_11 = Volume(Geometry=extr_19)  # -> Volume, Centroid
pl_offset_12 = PlaneOffset(BasePlane=volume_11.Centroid, Offset=20)
preview_19 = CustomPreview(Geometry=extr_19, Shader=cmyk_3)
extr_20 = Extrude(Base=boundary_13, Direction=amp_19)
volume_12 = Volume(Geometry=extr_20)  # -> Volume, Centroid
pl_offset_13 = PlaneOffset(BasePlane=volume_12.Centroid, Offset=20)
preview_20 = CustomPreview(Geometry=extr_20, Shader=rgb_12)
extr_21 = Extrude(Base=boundary_11, Direction=amp_17)
volume_13 = Volume(Geometry=extr_21)  # -> Volume, Centroid
pl_offset_14 = PlaneOffset(BasePlane=volume_13.Centroid, Offset=20)
preview_21 = CustomPreview(Geometry=extr_21, Shader=rgb_13)
extr_22 = Extrude(Base=boundary_12, Direction=amp_18)
volume_14 = Volume(Geometry=extr_22)  # -> Volume, Centroid
pl_offset_15 = PlaneOffset(BasePlane=volume_14.Centroid, Offset=20)
preview_22 = CustomPreview(Geometry=extr_22, Shader=rgb_11)
tag_9 = TextTag3D(Location=pl_offset_15, Text=panel_4, Size=number_slider_7)
tag_10 = TextTag3D(Location=pl_offset_13, Text=panel_5, Size=number_slider_7)
tag_11 = TextTag3D(Location=pl_offset_14, Text=panel_2, Size=number_slider_7)
tag_12 = TextTag3D(Location=pl_offset_11, Text=panel, Size=number_slider_7)
tag_13 = TextTag3D(Location=pl_offset_10, Text=panel_3, Size=number_slider_7)
tag_14 = TextTag3D(Location=pl_offset_9, Text=panel_7, Size=number_slider_7)
tag_15 = TextTag3D(Location=pl_offset_12, Text=panel_6, Size=number_slider_7)

# ----
sqrt_17 = SquareRoot(Value=ma_4.PartialResults)
sqrt_18 = SquareRoot(Value=ma_3.PartialResults)
sqrt_19 = SquareRoot(Value=ma_2.PartialResults)
sqrt_20 = SquareRoot(Value=ma.PartialResults)
sqrt_21 = SquareRoot(Value=ma_5.PartialResults)
sqrt_22 = SquareRoot(Value=ma_6.PartialResults)
sqrt_23 = SquareRoot(Value=ma_7.PartialResults)
lng_27 = ListLength(List=sqrt_17)
division = Division(A=sqrt_17, B=5)
lng_28 = ListLength(List=sqrt_18)
lng_29 = ListLength(List=sqrt_19)
division_2 = Division(A=sqrt_18, B=5)
division_3 = Division(A=sqrt_19, B=5)
lng_30 = ListLength(List=sqrt_20)
lng_31 = ListLength(List=sqrt_21)
lng_32 = ListLength(List=sqrt_22)
division_4 = Division(A=sqrt_20, B=5)
division_5 = Division(A=sqrt_21, B=5)
division_6 = Division(A=sqrt_22, B=5)
lng_33 = ListLength(List=sqrt_23)
division_7 = Division(A=sqrt_23, B=5)
rectangle_18 = Rectangle(Plane=PlaneXY(0, 0, 0), XSize=Slider(70, range=0..1000), YSize=Slider(70, range=0..1000), Radius=0)  # -> Rectangle, Length
rectangle_19 = Rectangle(Plane=PlaneXY(0, 0, 0), XSize=Slider(70, range=0..1000), YSize=Slider(70, range=0..1000), Radius=0)  # -> Rectangle, Length
rectangle_20 = Rectangle(Plane=PlaneXY(0, 0, 0), XSize=Slider(70, range=0..1000), YSize=Slider(70, range=0..1000), Radius=0)  # -> Rectangle, Length
rectangle_21 = Rectangle(Plane=PlaneXY(0, 0, 0), XSize=Slider(70, range=0..1000), YSize=Slider(70, range=0..1000), Radius=0)  # -> Rectangle, Length
rectangle_22 = Rectangle(Plane=PlaneXY(0, 0, 0), XSize=Slider(70, range=0..1000), YSize=Slider(70, range=0..1000), Radius=0)  # -> Rectangle, Length
rectangle_23 = Rectangle(Plane=PlaneXY(0, 0, 0), XSize=Slider(70, range=0..1000), YSize=Slider(70, range=0..1000), Radius=0)  # -> Rectangle, Length
rectangle_24 = Rectangle(Plane=PlaneXY(0, 0, 0), XSize=Slider(70, range=0..1000), YSize=Slider(70, range=0..1000), Radius=0)  # -> Rectangle, Length
timer_7 = Timer(TimerInterval=1000, Target=stopcount_4)
Z_23 = UnitZ(Factor=1)
Z_24 = UnitZ(Factor=1)
Z_25 = UnitZ(Factor=1)
Z_26 = UnitZ(Factor=1)
Z_27 = UnitZ(Factor=1)
Z_28 = UnitZ(Factor=1)
Z_29 = UnitZ(Factor=1)
number_slider_8 = Slider(9, range=0..10)
number_slider_9 = Slider(100, range=0..100)
multiplication_3 = Multiplication(A=number_slider_9, B=number_slider_8)
series_6 = Series(Start=0, Step=number_slider_9, Count=number_slider_8)
pt_8 = ConstructPoint(XCoordinate=series_6, YCoordinate=0, ZCoordinate=0)
pt_9 = ConstructPoint(XCoordinate=0, YCoordinate=series_6, ZCoordinate=0)
Y_3 = UnitY(Factor=1)
X_3 = UnitX(Factor=1)
line_5 = LineSDL(Start=pt_8, Direction=Y_3, Length=multiplication_3)
line_6 = LineSDL(Start=pt_9, Direction=X_3, Length=multiplication_3)
mcx_3 = MultipleCurves(Curves=[line_5, line_6])  # -> Points, IndexA, IndexB, ParamA, ParamB
toggle_4 = BooleanToggle(True)
stopcount_4 = StopCounter(Start=0, Step=1, Stop=100, Pause=toggle_4, Reset=False)
addition_7 = Addition(A=stopcount_4, B=1)
addition_8 = Addition(A=stopcount_4, B=5)
addition_9 = Addition(A=stopcount_4, B=6)
addition_10 = Addition(A=stopcount_4, B=3)
addition_11 = Addition(A=stopcount_4, B=4)
addition_12 = Addition(A=stopcount_4, B=2)
pop2d_9 = Populate2D(Region=rectangle_18.Rectangle, Count=lng_27, Seed=addition_7)
pop2d_10 = Populate2D(Region=rectangle_19.Rectangle, Count=lng_28, Seed=stopcount_4)
pop2d_11 = Populate2D(Region=rectangle_20.Rectangle, Count=lng_29, Seed=addition_12)
pop2d_12 = Populate2D(Region=rectangle_21.Rectangle, Count=lng_30, Seed=addition_10)
pop2d_13 = Populate2D(Region=rectangle_22.Rectangle, Count=lng_31, Seed=addition_11)
pop2d_14 = Populate2D(Region=rectangle_23.Rectangle, Count=lng_32, Seed=addition_9)
pop2d_15 = Populate2D(Region=rectangle_24.Rectangle, Count=lng_33, Seed=addition_8)
cir = Circle(Plane=pop2d_10, Radius=division_2)
boundary_17 = BoundarySurfaces(Edges=cir)
cir_2 = Circle(Plane=pop2d_9, Radius=division)
boundary_18 = BoundarySurfaces(Edges=cir_2)
cir_3 = Circle(Plane=pop2d_11, Radius=division_3)
boundary_19 = BoundarySurfaces(Edges=cir_3)
cir_4 = Circle(Plane=pop2d_12, Radius=division_4)
boundary_20 = BoundarySurfaces(Edges=cir_4)
cir_5 = Circle(Plane=pop2d_13, Radius=division_5)
boundary_21 = BoundarySurfaces(Edges=cir_5)
cir_6 = Circle(Plane=pop2d_15, Radius=division_7)
boundary_22 = BoundarySurfaces(Edges=cir_6)
cir_7 = Circle(Plane=pop2d_14, Radius=division_6)
boundary_23 = BoundarySurfaces(Edges=cir_7)
pl_offset_16 = PlaneOffset(BasePlane=cir, Offset=20)
pl_offset_17 = PlaneOffset(BasePlane=cir_2, Offset=20)
pl_offset_18 = PlaneOffset(BasePlane=cir_3, Offset=20)
pl_offset_19 = PlaneOffset(BasePlane=cir_4, Offset=20)
pl_offset_20 = PlaneOffset(BasePlane=cir_5, Offset=20)
pl_offset_21 = PlaneOffset(BasePlane=cir_6, Offset=20)
pl_offset_22 = PlaneOffset(BasePlane=cir_7, Offset=20)
lng_34 = ListLength(List=boundary_17)
lng_35 = ListLength(List=boundary_18)
lng_36 = ListLength(List=boundary_19)
lng_37 = ListLength(List=boundary_20)
lng_38 = ListLength(List=boundary_21)
lng_39 = ListLength(List=boundary_22)
lng_40 = ListLength(List=boundary_23)
random_26 = Random(Range=Domain(4, 4), Number=lng_34, Seed=2)
random_27 = Random(Range=Domain(4, 8), Number=lng_35, Seed=2)
random_28 = Random(Range=Domain(8, 8), Number=lng_36, Seed=2)
random_29 = Random(Range=Domain(4, 8), Number=lng_37, Seed=2)
random_30 = Random(Range=Domain(4, 4), Number=lng_38, Seed=2)
random_31 = Random(Range=Domain(4, 4), Number=lng_39, Seed=2)
random_32 = Random(Range=Domain(4, 8), Number=lng_40, Seed=2)
amp_23 = Amplitude(Vector=Z_23, Amplitude=random_26)
amp_24 = Amplitude(Vector=Z_24, Amplitude=random_27)
amp_25 = Amplitude(Vector=Z_25, Amplitude=random_28)
amp_26 = Amplitude(Vector=Z_26, Amplitude=random_29)
amp_27 = Amplitude(Vector=Z_27, Amplitude=random_30)
amp_28 = Amplitude(Vector=Z_28, Amplitude=random_31)
amp_29 = Amplitude(Vector=Z_29, Amplitude=random_32)
con = DelaunayEdges(Points=[cir, cir_2], Plane=PlaneXY(0, 0, 0))  # -> Connectivity, Edges
pipe = Pipe(Curve=con.Edges, Radius=0.5, Caps=2)  # -> flatten(Pipe)
path_mapper_8 = PathMapper(pipe, source="{path_count}", target="{path_count}")
timer_8 = Timer(TimerInterval=1000, Target=stopcount_5)
lng_41 = ListLength(List=mcx_3.Points)
stopcount_5 = StopCounter(Start=0, Step=1, Stop=lng_41, Pause=toggle_4, Reset=toggle_4)
not_3 = GateNot(A=toggle_4)
doclyrs_3 = RhinoLayers()  # -> Layers, LayerColours
item_26 = ListItem(List=mcx_3.Points, Index=stopcount_5, Wrap=True)
panel_10 = Panel(doclyrs_3.Layers)
extr_23 = Extrude(Base=boundary_19, Direction=amp_25)  # -> flatten(Extrusion)
extr_24 = Extrude(Base=boundary_21, Direction=amp_27)  # -> flatten(Extrusion)
extr_25 = Extrude(Base=boundary_20, Direction=amp_26)  # -> flatten(Extrusion)
extr_26 = Extrude(Base=boundary_18, Direction=amp_24)  # -> flatten(Extrusion)
extr_27 = Extrude(Base=boundary_22, Direction=amp_28)  # -> flatten(Extrusion)
extr_28 = Extrude(Base=boundary_17, Direction=amp_23)  # -> flatten(Extrusion)
extr_29 = Extrude(Base=boundary_23, Direction=amp_29)  # -> flatten(Extrusion)
path_mapper_9 = PathMapper(extr_29, source="{path_count}", target="{path_count+6}")
path_mapper_10 = PathMapper(extr_27, source="{path_count}", target="{path_count+5}")
path_mapper_11 = PathMapper(extr_23, source="{path_count}", target="{path_count+2}")
path_mapper_12 = PathMapper(extr_24, source="{path_count}", target="{path_count+4}")
path_mapper_13 = PathMapper(extr_28, source="{path_count}", target="{path_count}")
path_mapper_14 = PathMapper(extr_26, source="{path_count}", target="{path_count+1}")
path_mapper_15 = PathMapper(extr_25, source="{path_count}", target="{path_count+3}")
brep_3 = Brep([path_mapper_9, path_mapper_13, path_mapper_15, path_mapper_12, path_mapper_14, path_mapper_10, path_mapper_11, path_mapper_8])
move_11 = Move(Geometry=brep_3, Motion=item_26)  # -> Geometry, Transform
bake_3 = ObjectBake(
    BakeToggle=not_3,
    GeometryObjects=move_11.Geometry,
    Layer=doclyrs_3.Layers,
    ObjectName=doclyrs_3.Layers,
    ObjectColor=doclyrs_3.LayerColours,
    LayerColor=doclyrs_3.LayerColours)
tag_16 = TextTag3D(Location=pl_offset_16, Text=txt, Size=1)
tag_17 = TextTag3D(Location=pl_offset_17, Text=txt, Size=1)
tag_18 = TextTag3D(Location=pl_offset_18, Text=txt, Size=1)
tag_19 = TextTag3D(Location=pl_offset_19, Text=txt, Size=1)
tag_20 = TextTag3D(Location=pl_offset_20, Text=txt, Size=1)
tag_21 = TextTag3D(Location=pl_offset_21, Text=txt, Size=1)
tag_22 = TextTag3D(Location=pl_offset_22, Text=txt, Size=1)
