# Grasshopper definition Wind.gh (Grasshopper 0.9.14)
# plug-ins: GrasshopperCs

e2_resistencia_aerodinamica_1_low_1_high = Slider(-0.5, range=-1..-0.1)
e3_resistencia_aerodinamica_1_low_1_high = Slider(1, range=-1..5)
resistencia_aerodinamica_1_low_1_high = Slider(-0.5, range=-1..1)
e3_divisiones_horizontales_raycaster = Slider(1, range=0..50)
e3_divisiones_verticales_raycaster = Slider(4, range=0..50)
divisiones_superficie_horizontal = Slider(5, range=0..50)
e3_resistencia_aerodinamica_1_low_1_high_2 = Slider(1, range=-1..5)
e1_divisiones_horizontales = Slider(5, range=0..50)
divisiones_superficie_vertical = Slider(5, range=0..50)
e3_resistencia_aerodinamica_1_low_1_high_3 = Slider(1, range=-1..5)
e1_cantidad_rayos_x_punto = Slider(15, range=0..100)
divisiones_linea_de_corte = Slider(20, range=0..50)
offset_superficie_analysis = Slider(1, range=0..1)
e3_divisiones_horizontales_raycaster_2 = Slider(1, range=0..50)
e1_divisiones_verticales = Slider(5, range=0..50)
e3_divisiones_horizontales_raycaster_3 = Slider(0, range=0..50)
e1_apagado_true_encendido_false = BooleanToggle(True)
e2_apagado_true_encendido_false = BooleanToggle(True)
e2_cantidad_de_rayos = Slider(15, range=0..100)
e3_apagado_true_encendido_false = BooleanToggle(False)
e3_cantidad_de_rayos = Slider(15, range=0..100)
altura_corte_vientos = Slider(70, range=1..200)
e3_divisiones_verticales_raycaster_2 = Slider(4, range=0..50)
e1_offset_superficie = Slider(0, range=-1..1)
e2_offset_superficie = Slider(0, range=-1..1)
e1_estatico_true_dinamico_false = BooleanToggle(True)
e2_estatico_true_dinamico_false = BooleanToggle(True)
e3_estatico_true_dinamico_false = BooleanToggle(False)
e2_friccion_del_aire = Slider(0.5, range=0..1)
e3_friccion_del_aire = Slider(0.23, range=0..1)
e3_divisiones_verticales_raycaster_3 = Slider(2, range=0..50)
turbulencia = Slider(0, range=0..0.4)
friccion_del_aire = Slider(0.4, range=0.01..1)
e2_turbulencia = Slider(0, range=0..1)
md_slider = MDSlider(
    slider_value=Point(1, 0.6348588525, 0.5),
    x_domain=Domain(-1, 1),
    y_domain=Domain(-1, 1),
    z_domain=Domain(0, 1),
    SliderMode=0)
respawn_aire = Slider(1, range=0..10)
respawn_aire_2 = Slider(5, range=0..5)
aire_random = Slider(5, range=0..5)
aire_random_2 = Slider(1, range=0..1)
e3_apagado_true_encendido_false_2 = BooleanToggle(False)
e3_cantidad_de_rayos_2 = Slider(10, range=0..100)
escala = Slider(1, range=0..1)
e3_apagado_true_encendido_false_3 = BooleanToggle(False)
e3_cantidad_de_rayos_3 = Slider(10, range=0..100)
e3_estatico_true_dinamico_false_2 = BooleanToggle(False)
e3_friccion_del_aire_2 = Slider(0, range=0..1)
e3_estatico_true_dinamico_false_3 = BooleanToggle(False)
e3_friccion_del_aire_3 = Slider(0, range=0..1)
escala_2 = Slider(1, range=0..1)
respawn_aire_3 = Slider(5, range=0..5)
aire_random_3 = Slider(5, range=0..5)
md_slider_2 = MDSlider(
    slider_value=Point(0.5835026066, 1, 0.5),
    x_domain=Domain(-1, 1),
    y_domain=Domain(-1, 1),
    z_domain=Domain(0, 1),
    SliderMode=0)
escala_3 = Slider(1, range=0..1)
respawn_aire_4 = Slider(10, range=0..10)
aire_random_4 = Slider(5, range=0..10)
md_slider_3 = MDSlider(
    slider_value=Point(0.5473171327, 1, 0.5),
    x_domain=Domain(-1, 1),
    y_domain=Domain(-1, 1),
    z_domain=Domain(0, 1),
    SliderMode=0)
brep = Brep([<brep referenced from the Rhino model> x4])
brep_2 = Brep([<brep referenced from the Rhino model> x4])
brep_3 = Brep([<brep referenced from the Rhino model> x4])
surface = Surface(<surface referenced from the Rhino model>)
Z = UnitZ(Factor=altura_corte_vientos)
unit = UnitVector(Vector=md_slider)
surface_2 = Surface([<surface referenced from the Rhino model> x2])
surface_3 = Surface(<surface referenced from the Rhino model>)
unit_2 = UnitVector(Vector=md_slider_2)
unit_3 = UnitVector(Vector=md_slider_3)
move = Move(Geometry=surface, Motion=Z)  # -> Geometry, Transform
vadd = VectorAddition(Vector=unit)
scale = Scale(ScaleFactor=escala, FallOffRange=1000)
amp = Amplitude(Vector=unit, Amplitude=20)
offset = Offset(Surface=brep, Distance=offset_superficie_analysis, Retrim=True)  # disabled
vadd_2 = VectorAddition(Vector=unit_2)
scale_2 = Scale(ScaleFactor=escala_2, FallOffRange=1000)
vadd_3 = VectorAddition(Vector=unit_3)
scale_3 = Scale(ScaleFactor=escala_3, FallOffRange=1000)
amp_2 = Amplitude(Vector=unit_2, Amplitude=20)
amp_3 = Amplitude(Vector=unit_3, Amplitude=20)
offset_2 = Offset(Surface=brep, Distance=e1_offset_superficie, Retrim=True)
bbx = BrepBrep(BrepA=move.Geometry, BrepB=brep)  # -> Curves, Points
divide = DivideDomain²(Domain=offset, UCount=divisiones_superficie_vertical, VCount=divisiones_superficie_horizontal)
vdis = VectorDisplay(Anchors=Point(18, 80, 0), Vectors=amp)
prts = SPMParticleLifeTimeSettings(Respawn=True, NewSpawnStepCount=respawn_aire, RandomizeNewSpawn=aire_random_2)
prts_2 = SPMParticleLifeTimeSettings(Respawn=True, NewSpawnStepCount=respawn_aire_2, RandomizeNewSpawn=aire_random)
subsrf = Isotrim(Surface=brep, Domain=divide)
vdis_2 = VectorDisplay(Anchors=Point(18, 80, 0), Vectors=amp_2)
vdis_3 = VectorDisplay(Anchors=Point(18, 80, 0), Vectors=amp_3)
sdivide = DivideSurface(Surface=offset_2, UCount=e1_divisiones_horizontales, VCount=e1_divisiones_verticales)  # -> Points, Normals, Parameters
satt = SurfaceAttraction(Surfaces=brep, AttractionStrength=resistencia_aerodinamica_1_low_1_high, DistanceExponent=0)
satt_2 = SurfaceAttraction(Surfaces=brep, AttractionStrength=e2_resistencia_aerodinamica_1_low_1_high, DistanceExponent=0)
satt_3 = SurfaceAttraction(Surfaces=brep, AttractionStrength=e3_resistencia_aerodinamica_1_low_1_high, DistanceExponent=0)
coh = Cohesion(Radius=10, Strength=turbulencia)
sbnc = SurfaceBounce(Surfaces=brep, Restitution=friccion_del_aire)
offset_3 = Offset(Curve=bbx.Curves, Distance=e2_offset_superficie, Plane=PlaneXY(0, 0, 0), Corners=1)
sbnc_2 = SurfaceBounce(Surfaces=brep, Restitution=e2_friccion_del_aire)
coh_2 = Cohesion(Radius=10, Strength=e2_turbulencia)
sbnc_3 = SurfaceBounce(Surfaces=brep, Restitution=e3_friccion_del_aire)
prts_3 = SPMParticleLifeTimeSettings(Respawn=True, NewSpawnStepCount=respawn_aire_3, RandomizeNewSpawn=aire_random_3)
prts_4 = SPMParticleLifeTimeSettings(Respawn=True, NewSpawnStepCount=respawn_aire_4, RandomizeNewSpawn=aire_random_4)
sdivide_2 = DivideSurface(Surface=surface_2, UCount=e3_divisiones_horizontales_raycaster_2, VCount=e3_divisiones_verticales_raycaster_2)  # -> Points, Normals, Parameters
sbnc_4 = SurfaceBounce(Surfaces=brep_2, Restitution=e3_friccion_del_aire_2)
satt_4 = SurfaceAttraction(Surfaces=brep_2, AttractionStrength=e3_resistencia_aerodinamica_1_low_1_high_2, DistanceExponent=0)
sdivide_3 = DivideSurface(Surface=surface_3, UCount=e3_divisiones_horizontales_raycaster_3, VCount=e3_divisiones_verticales_raycaster_3)  # -> Points, Normals, Parameters
sbnc_5 = SurfaceBounce(Surfaces=brep_3, Restitution=e3_friccion_del_aire_3)
satt_5 = SurfaceAttraction(Surfaces=brep_3, AttractionStrength=e3_resistencia_aerodinamica_1_low_1_high_3, DistanceExponent=0)
explode = BrepComponents(Brep=subsrf)  # -> Faces, Edges, Vertices
sdivide_4 = DivideSurface(Surface=surface, UCount=e3_divisiones_horizontales_raycaster, VCount=e3_divisiones_verticales_raycaster)  # -> Points, Normals, Parameters
divide_2 = DivideCurve(Curve=offset_3, Count=divisiones_linea_de_corte, Kinks=False)  # -> Points, Tangents, Parameters
timer = Timer(TimerInterval=20, Target=spm_integration)  # disabled
timer_2 = Timer(TimerInterval=500, Target=spm_integration_4)
spm_integration = SPMVectorFieldIntegration(
    StartPoints=sdivide.Points,
    ParticleLifeTime=e1_cantidad_rayos_x_punto,
    Dynamics=[vadd, scale, satt, coh, sbnc],
    Settings=prts,
    DynamicSimulation=e1_apagado_true_encendido_false,
    ResetSimulation=e1_estatico_true_dinamico_false)  # -> TravelledPointsTree, TravelledVectorsTree
spm_integration_2 = SPMVectorFieldIntegration(
    StartPoints=divide_2.Points,
    ParticleLifeTime=e2_cantidad_de_rayos,
    Dynamics=[vadd, scale, satt_2, coh_2, sbnc_2],
    DynamicSimulation=e2_apagado_true_encendido_false,
    ResetSimulation=e2_estatico_true_dinamico_false)  # -> TravelledPointsTree, TravelledVectorsTree
spm_integration_3 = SPMVectorFieldIntegration(
    StartPoints=sdivide_4.Points,
    ParticleLifeTime=e3_cantidad_de_rayos,
    Dynamics=[scale, vadd, satt_3, sbnc_3],
    Settings=prts_2,
    DynamicSimulation=e3_apagado_true_encendido_false,
    ResetSimulation=e3_estatico_true_dinamico_false)  # -> TravelledPointsTree, TravelledVectorsTree
timer_3 = Timer(TimerInterval=200, Target=spm_integration_2)
timer_4 = Timer(TimerInterval=500, Target=spm_integration_3)
timer_5 = Timer(TimerInterval=500, Target=spm_integration_5)
item = ListItem(List=explode.Vertices, Index=0, Wrap=False)
item_2 = ListItem(List=explode.Vertices, Index=1, Wrap=False)
item_3 = ListItem(List=explode.Vertices, Index=2, Wrap=False)
item_4 = ListItem(List=explode.Vertices, Index=3, Wrap=False)
spm_integration_4 = SPMVectorFieldIntegration(
    StartPoints=sdivide_2.Points,
    ParticleLifeTime=e3_cantidad_de_rayos_2,
    Dynamics=[scale_2, vadd_2, satt_4, sbnc_4],
    Settings=prts_3,
    DynamicSimulation=e3_apagado_true_encendido_false_2,
    ResetSimulation=e3_estatico_true_dinamico_false_2)  # -> TravelledPointsTree, TravelledVectorsTree
spm_integration_5 = SPMVectorFieldIntegration(
    StartPoints=sdivide_3.Points,
    ParticleLifeTime=e3_cantidad_de_rayos_3,
    Dynamics=[scale_3, vadd_3, satt_5, sbnc_5],
    Settings=prts_4,
    DynamicSimulation=e3_apagado_true_encendido_false_3,
    ResetSimulation=e3_estatico_true_dinamico_false_3)  # -> TravelledPointsTree, TravelledVectorsTree
srf4pt = _4PointSurface(CornerA=item, CornerB=item_2, CornerC=item_3, CornerD=item_4)
vdis_4 = VectorDisplay(
    Anchors=spm_integration.TravelledPointsTree,
    Vectors=spm_integration.TravelledVectorsTree,
    stops=[0: RGB(255, 0, 0), 0.5: RGB(255, 165, 0), 1: RGB(124, 252, 0)])
vdis_5 = VectorDisplay(
    Anchors=spm_integration_2.TravelledPointsTree,
    Vectors=spm_integration_2.TravelledVectorsTree,
    stops=[0: RGB(255, 0, 0), 0.5: RGB(255, 165, 0), 1: RGB(124, 252, 0)])
vdis_6 = VectorDisplay(
    Anchors=spm_integration_3.TravelledPointsTree,
    Vectors=spm_integration_3.TravelledVectorsTree,
    stops=[0: RGB(255, 0, 0), 0.5: RGB(255, 165, 0), 1: RGB(124, 252, 0)])
vdis_7 = VectorDisplay(
    Anchors=spm_integration_4.TravelledPointsTree,
    Vectors=spm_integration_4.TravelledVectorsTree,
    stops=[0: RGB(255, 0, 0), 0.5: RGB(255, 165, 0), 1: RGB(124, 252, 0)])
vdis_8 = VectorDisplay(
    Anchors=spm_integration_5.TravelledPointsTree,
    Vectors=spm_integration_5.TravelledVectorsTree,
    stops=[0: RGB(255, 0, 0), 0.5: RGB(255, 165, 0), 1: RGB(124, 252, 0)])
area = Area(Geometry=srf4pt)  # -> Area, Centroid
srf_cp = SurfaceCP(Point=area.Centroid, Surface=brep)  # -> Point, UVPoint, Distance
eval = EvaluateSurface(Surface=brep, Point=srf_cp.UVPoint)  # -> Point, Normal, Frame
vec = Vector(md_slider)
rev = Reverse(Vector=eval.Normal)
unit_4 = UnitVector(Vector=vec)
angle = Angle(VectorA=rev, VectorB=unit_4)  # -> graft(Angle), Reflex
N = VectorLength(Vector=rev)  # -> simplify(Length)
cos = Cosine(Input=angle.Angle)
n_cos = Multiplication(A=N, B=cos)  # -> simplify(Result)
sort = SortList(Keys=flatten(n_cos))  # -> Keys, ValuesA
lng = ListLength(List=sort.Keys)
máx = ListItem(List=sort.Keys, Index=expr("i-1", lng), Wrap=False)
min = ListItem(List=sort.Keys, Index=0, Wrap=False)
gradient = Gradient(
    LowerLimit=máx,
    UpperLimit=min,
    Parameter=n_cos,
    stops=[0: RGB(0, 0, 255), 0.2: RGB(0, 192, 192), 0.4: RGB(110, 217, 11), 0.599: RGB(240, 240, 62), 0.801: RGB(255, 128, 0), 1: RGB(255, 0, 0)])
preview = CustomPreview(Geometry=srf4pt, Shader=gradient)
